# Grasshopper definition assembly_design.ghx (Grasshopper 1.0.8)

# ----
# Generate brick parts
# Climatic Simulation to unlock self-shading properties
list = ValueList({"none", "full", "insulated", "half"}, selected="half")
part = Python3Script()  # -> out, brick_full, brick_insulated, brick_half
# ---------- part: Python ----------
import os
from compas.geometry import Frame, Box
from compas.datastructures import Mesh
from climate_active_envelopes.assembly import CAEPart as Part



#brick_full
length, width, height = 0.24, 0.115, 0.075
brick_full = Part.from_dimensions(length=length, width=width, height=height)
brick_full.attributes['name'] = "brick_full"
#print(brick_full.attributes)
print(brick_full.__data__)


#brick_insulated_placeholder_new
length, width, height = 0.24, 0.115, 0.075
brick_insulated = Part.from_dimensions(length=length, width=width, height=height)
brick_insulated.attributes['name'] = "brick_insulated"
print(brick_insulated.__data__)


# #brick_insulated_placeholder
# length, width, height = 0.245, 0.12, 0.075
# brick_insulated = Part.from_dimensions(length=length, width=width, height=height)
# brick_insulated.attributes['name'] = "brick_insulated"
# print(brick_insulated.__data__)

#corner brick
length, width, height = 0.24, 0.0575, 0.075
brick_half = Part.from_dimensions(length=length, width=width, height=height)
brick_half.attributes['name'] = "brick_half"
print(brick_half.__data__)

#brick_insulated
# package_path = ghdoc.Path
# data_path = os.path.abspath(os.path.join(package_path,"../../../climate_active_envelopes/data/brick_types"))
# filename = 'brick_insulated_reduced.stl'
# brick_insulated_mesh = Mesh.from_stl(os.path.join(data_path, filename))
# brick_insulated = Part.from_mesh_and_frame(brick_insulated_mesh)
# brick_insulated.attributes['name'] = "brick_insulated"
# #print(brick_insulated.__data__)
# ---------- end part ----------
draw = Python3Script(brick_full=part.brick_full, brick_insulated=part.brick_insulated, brick_half=part.brick_half, show=list)  # -> M, P
# ---------- draw: Python ----------
from compas_rhino.conversions import mesh_to_rhino, box_to_rhino, frame_to_rhino
from climate_active_envelopes.assembly import CAEPart as Part
from compas.geometry import Frame
from compas.geometry import Vector
from compas.geometry import Box


if show=="full":

    #extract the mesh of the part for visulization
    compas_mesh_full = brick_full.mesh

    #convert to rhino mesh
    M = mesh_to_rhino(compas_mesh_full)

    #extract and convert to rhino plane
    P = frame_to_rhino(brick_full.frame)
    #brick_full.gripping_frame = full_brick.frame
    #print(full_brick.__data__)
    print(type(brick_full))

    
elif show == "insulated":
    
    #extract the mesh of the part for visulization
    compas_mesh_insulated = brick_insulated.mesh

    #convert to rhino mesh
    M = mesh_to_rhino(compas_mesh_insulated)
    
    #extract and convert to rhino plane
    P = frame_to_rhino(brick_insulated.frame)

elif show == "half":

    #extract the mesh of the part for visulization
    compas_mesh_half = brick_half.mesh

    #convert to rhino mesh
    M = mesh_to_rhino(compas_mesh_half)
    
    #extract and convert to rhino plane
    P = frame_to_rhino(brick_half.frame)

else:
    pass
# ---------- end draw ----------
mesh = Mesh(draw.M)
pln = Plane(draw.P)

# ----
# Reference Model
geo = Geometry(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)
geo_2 = Geometry(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)

compas = Python3Script()  # -> out
# ---------- compas: Python ----------
import compas
print(compas.__version__)
# ---------- end compas ----------

# ----
# Unload Python modules
button = Button()
unload = Python3Script(unload=button)  # -> out, a
# ---------- unload: Python ----------
#from compas_ghpython import unload_modules
from compas_rhino import unload_modules

unload_modules('climate_active_envelopes')
unload_modules('assembly_information_model')
# ---------- end unload ----------

quad = Quadrangulate(Mesh=geo_2, Angle=0.03490658504, Ratio=0.875)  # -> Mesh, Count
quad_2 = Quadrangulate(Mesh=geo, Angle=0.03490658504, Ratio=0.875)  # -> Mesh, Count
referencemodel = Python3Script(units=[quad_2.Mesh, quad.Mesh])  # -> out, reference_model; inputs units: list of Mesh
# ---------- referencemodel: Python ----------
from climate_active_envelopes.assembly import CAEReferenceModel 
from compas_rhino.conversions import mesh_to_compas
from compas.datastructures import Mesh, CellNetwork


reference_model = CAEReferenceModel()

mesh_units = []
print(mesh_units)
for unit in units:
    mesh_units.append(mesh_to_compas(unit))

reference_model = reference_model.create_cell_network(mesh_units)
print(reference_model)

reference_model.initialize_network()
# ---------- end referencemodel ----------

# ----
# Create empty assembly
# datastructure
button_2 = Button()
assembly = Python3Script(init=button_2)  # -> out, my_assembly
# ---------- assembly: Python ----------
from climate_active_envelopes.assembly import CAEAssembly as Assembly

#create empty assembly
my_assembly = Assembly()
# ---------- end assembly ----------

compas___version = Panel(compas)

context_input = Brep(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)
epw_file = FilePath("C:\Users\julia\Downloads\DEU_BY_Munich-Theresienwiese.108650_TMYx\DEU_BY_Munich-Theresienwiese.108650_TMYx.epw")

number_slider = Slider(0, range=0..360)

list_2 = ValueList({"clockwise": "right", "counter clockwise": "left"}, selected="counter clockwise")
list_3 = ValueList({"rotate", "translate"}, selected="translate")

# ----
# Brick Assembly & Brick Parts
list_4 = ValueList({"From Reference Model": "reference_model", "From Input Surface": "mesh"}, selected="From Input Surface")
input_surface = Brep(<brep referenced from the Rhino model>)

# ----
# Shading Simulation
run = BooleanToggle(True)
sun_hours = SunHours(
    start_month=Slider(6, range=0..10),
    start_day=Slider(1, range=0..10),
    start_hour=Slider(11, range=0..100),
    end_month=Slider(8, range=0..10),
    end_day=Slider(31, range=0..100),
    end_hour=Slider(16, range=0..100),
    north=number_slider,
    geometry=input_surface,
    epw_file=epw_file,
    context=context_input,
    grid_size=Slider(0.04, range=0..0.1),
    run=run)  # -> hoys, location, points, results, sky_mtx, mesh, legend
geo_3 = Geometry(sun_hours.legend)
panel = Panel(geo_3)

compute = BooleanToggle(True)
list_5 = ValueList({"Cross": "cross", "Straight": "straight", "Diamond": "diamond"}, selected="Diamond")

# ----
# Create brick assembly
course_height = Slider(0.087, range=0..1)
list_6 = ValueList({"Flemish bond": "flemish_bond", "Vertical bond": "vertical_bond", "Fench bond": "french_bond"}, selected="Flemish bond")
list_7 = ValueList({"Single layer": "single_layer", "Double layer": "double_layer"}, selected="Single layer")
create_assembly = Python3Script(
    compute=compute,
    reference_model=referencemodel.reference_model,
    my_assembly=assembly.my_assembly,
    surface=input_surface,
    input_type=list_4,
    bond_type=list_6,
    ornament=list_5,
    wall_system=list_7,
    brick_full=part.brick_full,
    brick_insulated=part.brick_insulated,
    brick_half=part.brick_half,
    brick_spacing=Slider(0.015, range=0..0.1),
    course_height=course_height)  # -> out, start_edge_type, end_edge_type, current_face_type, my_assembly; inputs surface: Surface, brick_spacing: Double, course_height: Double
# ---------- create_assembly: Python ----------
from compas_rhino.conversions import mesh_to_compas, surface_to_compas_mesh


if compute:
    mesh = surface_to_compas_mesh(surface, 1)

    my_assembly.set_brick_params(brick_full, brick_insulated, brick_half)


    # if input_type == "reference_model":
    #     input_data = reference_model


    if input_type == "mesh":
        input_data = mesh

    # assembly_data = (reference_model.generate_assembly_data(input_data, course_height, input_type))
    # print(assembly_data)
    # start_edge_type = assembly_data['start_edge_type']
    # end_edge_type = assembly_data['end_edge_type']
    # current_face_type = assembly_data['face_type']

    my_assembly.generate_wall(reference_model,
                        bond_type, 
                        ornament,
                        wall_system,  
                        brick_spacing, 
                        course_height,
                        input_type,
                        input_data
                        )
# ---------- end create_assembly ----------
panel_2 = Panel(create_assembly.current_face_type)
panel_3 = Panel(create_assembly.end_edge_type)
panel_4 = Panel(create_assembly.start_edge_type)

# ----
# Sun Path
number_slider_2 = Slider(0.4, range=0..10)
pt = Point(Point(-6.494743299, -6.882496362, 0))
sunpath = LBSunPath(north=number_slider, location=sun_hours.location, hoys=sun_hours.hoys, center_pt=pt, scale=number_slider_2)  # -> report, vectors, altitudes, azimuths, hoys, sun_pts, analemma, daily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; plug-in component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
geo_4 = Geometry([sunpath.compass, sunpath.daily, sunpath.analemma, sunpath.legend, sunpath.title, sunpath.sun_pts])

# ----
# Apply Gradient
values = Python3Script(results=sun_hours.results, min_value=Slider(0.1, range=0..0.1), max_value=Slider(0.5, range=0..0.5))  # -> out, normalized_values; inputs results: list
# ---------- values: Python ----------
from compas.itertools import normalize_values



def normalize_to_highest(values, max_value=140.0, target_min=0.1, target_max=1):
    """Normalizes a list of values based on the highest value in the list, 
    scaled to a specific range.

    Args:
    values: A list of numerical values.
    max_value: The expected maximum value. Defaults to 140.0.
    target_min: The minimum value of the target range. Defaults to 0.0.
    target_max: The maximum value of the target range. Defaults to 1.0.

    Returns:
    A list of normalized values.
    """
    highest_value = max(values)

    factor = highest_value / max_value
    print(factor)  # Calculate the scaling factor
    normalized_values = normalize_values(values, target_min, target_max * factor)
    return normalized_values

normalized_values = normalize_values(results, min_value, max_value)
#normalized_values = normalize_to_highest(results)
#print(color_values)

print(max(normalized_values))

print(normalized_values)
# ---------- end values ----------
keys = Python3Script(my_assembly=create_assembly.my_assembly, transform_type=list_3)  # -> out, my_assembly, keys; inputs transform_type: String
# ---------- keys: Python ----------
# for node_id in my_assembly.graph.nodes():
#     transform_type = my_assembly.graph.node_attribute(node_id, 'transform_type')





keys = []
for key in my_assembly.graph.nodes_where({"transform_type": transform_type}):
    keys.append(key)

print(keys)
print(transform_type)
# ---------- end keys ----------
apply_gradient = Python3Script(
    my_assembly=keys.my_assembly,
    normalized_values=values.normalized_values,
    pts=sun_hours.points,
    keys=keys.keys,
    transform_type=list_3,
    rotation_direction=list_2,
    nrbh_size=Slider(50, range=3..100),
    transform=Button())  # -> out, my_assembly; inputs normalized_values: list, pts: list of Point3d, keys: list, nrbh_size: Int32
# ---------- apply_gradient: Python ----------
import math
import Rhino.Geometry as rg
from compas.geometry import Frame, Point
from compas.geometry import Transformation, Rotation, Translation
from compas_rhino.conversions import point_to_compas
from scipy.spatial import cKDTree

#print(my_assembly.apply_gradient(values, keys, transform_type))

points = []

for p in pts:
    point = point_to_compas(p)
    points.append(point)

#print(keys)

tree = cKDTree(points)
print(tree)
#print(my_assembly.__data__)

transform_types = {node_id: my_assembly.graph.node_attribute(node_id, 'transform_type') for node_id in my_assembly.graph.nodes()}
#print(transform_types)

if transform:
    assembly = my_assembly
    my_assembly.apply_gradient(normalized_values,points,keys,transform_type, rotation_direction, nrbh_size)

    #print(test)
# ---------- end apply_gradient ----------

visualize = Python3Script(show=Toggle(True), mesh=sun_hours.mesh)  # -> out, M
# ---------- visualize: Python ----------
if show == True:
    M = mesh
# ---------- end visualize ----------
mesh_2 = Mesh(visualize.M)

start = Button()
stop = Button()
step = Button()
back = Button()
reset = Button()
full = Button()
list_8 = ValueList({"20", "50", "100", "500", "1000", "5000"}, selected="500")

list_9 = ValueList({"show all": "show_all", "show until key": "show_until_key", "show nothing": "show_nothing", "show connections": "show_connections", "show patches": "show_patches"}, selected="show all")

# ----
# Radiation Simulation
run_2 = BooleanToggle(False)

# ----
# Visualize Assembly
counter = Python3Script(
    my_assembly=apply_gradient.my_assembly,
    start=start,
    stop=stop,
    step=step,
    step_back=back,
    reset=reset,
    full=full,
    interval=list_8)  # -> out, counter
# ---------- counter: Python ----------
from scriptcontext import sticky as st
import Grasshopper

def update_component(ghenv, delay):
    """Schedule an update of the Grasshopper component.

    After the specified delay, the GH component will be automatically updated.

    Parameters
    ----------
    ghenv : :class:`GhPython.Component.PythonEnvironment`
        The current GHPython environment.
    delay : :obj:`int`
        Time in milliseconds until the update is performed.

    Raises
    ------
    ValueError
        If the delay is less than zero.

    """
    if delay <= 0:
        raise ValueError("Delay must be greater than zero")

    ghcomp = ghenv.Component
    ghdoc = ghcomp.OnPingDocument()

    def callback(ghdoc):
        if ghdoc.SolutionState != Grasshopper.Kernel.GH_ProcessStep.Process:
            ghcomp.ExpireSolution(False)

    ghdoc.ScheduleSolution(delay, Grasshopper.Kernel.GH_Document.GH_ScheduleDelegate(callback))

L = range(my_assembly.graph.number_of_nodes())

# store data in component
guid = str(ghenv.Component.InstanceGuid)
counter_key = "counter_" + guid
running_key = "running_" + guid

if counter_key not in st:
    st[counter_key] = 0

if running_key not in st:
    st[running_key] = False
    

if st[running_key]:
    if st[counter_key] < len(L) - 1:
        st[counter_key] += 1
        update_component(ghenv, interval)
    else:
        st[counter_key] = 0
        st[running_key] = False
    
if start:
    st[running_key] = True

if stop:
    st[running_key] = False

if step:
    if st[counter_key] < len(L) - 1:
        st[counter_key] += 1

if step_back:
    if st[counter_key] < len(L) - 1:
        st[counter_key] -= 1

if reset:
    st[counter_key] = 0
    st[running_key] = False

if full:
    st[counter_key] = len(L)-1

if len(L):
    item = L[st[counter_key]]


#st["visualisation_counter"] = st[counter_key]
counter = st[counter_key]+1
# ---------- end counter ----------
panel_5 = Panel(counter.counter)
visualize_2 = Python3Script(my_assembly=apply_gradient.my_assembly, show=list_9, highlight_current_part=Toggle(False), counter=panel_5)  # -> out, parts_geometry, parts_frame, current_part_geometry, current_part_frame, current_part_gripping_frame, connections, patches, patches_color
# ---------- visualize_2: Python ----------
from compas_rhino.conversions import mesh_to_rhino, box_to_rhino, frame_to_rhino
import Rhino.Geometry as rg
import ghpythonlib.components as ghcomp
from compas.colors import Color


#print assembly
print(my_assembly)
#counter = int(counter)

#get parts datastructure
parts = [p for p in my_assembly.parts()]
connections = []
patches = []
patches_color = []
#get current part

#if show_wall == True:

if show == "show_all":
    
#get parts datastructure
    parts = [p for p in my_assembly.parts()]
    parts_geometry = []
    parts_frame = []

    #part = parts[0]
    #print(part.gripping_frame)

    #extract the mesh of the parts for visulization (+ converted to rhino mesh)
    parts_geometry = [mesh_to_rhino(p.mesh) for p in parts]
    
    #extract the frame of the parts for visulization (+ converted to rhino plane)
    parts_frame = [frame_to_rhino(p.frame) for p in parts]
    print(parts_frame)

    key = my_assembly.graph.number_of_nodes()-1

if show == "show_until_key":
    #extract the mesh of the parts for visulization (+ converted to rhino mesh)
    parts_geometry = [mesh_to_rhino(p.mesh) for p in parts[0:int(counter)]]
    
    #extract the frame of the parts for visulization (+ converted to rhino plane)
    parts_frame = [frame_to_rhino(p.frame) for p in parts[0:int(counter)]]

    key = int(counter)-1

if show == "show_nothing":
    print("Nothing to see")
    pass



if show == "show_connections":
    edges = list(my_assembly.connections())
    for e in edges:
        p1 = my_assembly.part(e[0]).frame.point
        p2 = my_assembly.part(e[1]).frame.point
        connections += [rg.Line(p1[0],p1[1],p1[2],p2[0],p2[1],p2[2])]

if show == "show_patches":
    c_max = max(my_assembly.graph.nodes_attribute(name='patch')) + 1
    for patch_index in range(1, c_max):
        keys_in_patch = list(my_assembly.graph.nodes_where({'patch': patch_index}))
        parts = [my_assembly.part(key) for key in keys_in_patch]
        for p in parts:
            patches.append(mesh_to_rhino(p.mesh))
            color_value = (1 - patch_index / c_max) - 0.2
            color_value = max(0, min(color_value, 1))  # Ensure the color value is within [0, 1]   
            r = int(255 * (3*color_value))
            g = int(255 * (5*color_value))
            b = int(255 * (1.5*color_value))          
            patches_color.append(ghcomp.ColourRGB(r, g, b))


if highlight_current_part:
    current_part = my_assembly.part(key)
    current_part_geometry = mesh_to_rhino(current_part.mesh)
    current_part_frame = frame_to_rhino(current_part.frame)
    current_part_gripping_frame = frame_to_rhino(current_part.gripping_frame)
    
    print(current_part.__data__)
# ---------- end visualize_2 ----------
panel_6 = Panel(visualize_2.out)

radiation_simulation = RadiationSimulation(sky_mtx=sun_hours.sky_mtx, geometry=visualize_2.parts_geometry, context=context_input, run=run_2)  # -> mesh, legend
brick_wall = Mesh(radiation_simulation.mesh)
geo_5 = Geometry(radiation_simulation.legend)

geo_6 = Geometry(visualize_2.connections)
geo_7 = Geometry([visualize_2.current_part_frame, visualize_2.current_part_geometry])
geo_8 = Geometry(visualize_2.parts_geometry)
geo_9 = Geometry(visualize_2.parts_frame)
geo_10 = Geometry(visualize_2.current_part_gripping_frame)
geo_11 = Geometry(visualize_2.patches)
preview = CustomPreview(Geometry=geo_8, Material=ColourSwatch(SwatchColor=RGB(196, 141, 141)))
preview_2 = CustomPreview(Geometry=geo_9, Material=ColourSwatch(SwatchColor=RGB(255, 125, 157)))
preview_3 = CustomPreview(Geometry=geo_7, Material=ColourSwatch(SwatchColor=RGB(255, 125, 157)))
preview_4 = CustomPreview(Geometry=geo_10, Material=ColourSwatch(SwatchColor=RGB(255, 125, 157)))
preview_5 = CustomPreview(Geometry=geo_6, Material=ColourSwatch(SwatchColor=RGB(177, 255, 157)))
preview_6 = CustomPreview(Geometry=geo_11, Material=visualize_2.patches_color)

draw_2 = Python3Script(planes=geo_10, scale=Slider(0.2, range=0..1))  # -> out, P, V, C, W; inputs planes: list of Plane
# ---------- draw_2: Python ----------
from System.Drawing import Color

red = Color.FromArgb(255, 0, 0)
green = Color.FromArgb(0, 255, 0)
blue = Color.FromArgb(0, 0, 255)

P = []
V = []
C = []

scale = float(scale)

for plane in planes:
    if not plane:
        continue
    P += [plane.Origin] * 3
    V.append(plane.XAxis * scale)
    V.append(plane.YAxis * scale)
    V.append(plane.ZAxis * scale)
    C += [red, green, blue]

W = 3
# ---------- end draw_2 ----------
vdisex = VectorDisplayEx(Point=draw_2.P, Vector=draw_2.V, Colour=draw_2.C, Width=draw_2.W)

# ==== cluster SunHours
epw_file = ClusterInput()
start_month = ClusterInput()
start_day = ClusterInput()
start_hour = ClusterInput()
end_month = ClusterInput()
end_day = ClusterInput()
end_hour = ClusterInput()
importepw = LBImportEPW(epw_file=epw_file)  # -> location, dry_bulb_temperature, dew_point_temperature, relative_humidity, wind_speed, wind_direction, direct_normal_rad, diffuse_horizontal_rad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; plug-in component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
analysisperiod = LBAnalysisPeriod(
    start_month=start_month,
    start_day=start_day,
    start_hour=start_hour,
    end_month=end_month,
    end_day=end_day,
    end_hour=end_hour)  # -> period, hoys, dates; plug-in component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
hoys = ClusterOutput(analysisperiod.hoys)
north = ClusterInput()
skymatrix = LBCumulativeSkyMatrix(
    north=north,
    location=importepw.location,
    direct_rad=importepw.direct_normal_rad,
    diffuse_rad=importepw.diffuse_horizontal_rad,
    hoys=analysisperiod.hoys)  # -> report, sky_mtx; plug-in component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
location = ClusterOutput(importepw.location)
sky_mtx = ClusterOutput(skymatrix.sky_mtx)
colrange = LBColorRange(index=Slider(5, range=0..100))  # -> colors; plug-in component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
base_plane = ClusterInput()
geometry = ClusterInput()
context = ClusterInput()
grid_size = ClusterInput()
run = ClusterInput()
legendpar = LBLegendParameters(colors=colrange, base_plane=base_plane)  # -> leg_par; plug-in component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
incidentradiation = LBIncidentRadiation(
    sky_mtx=skymatrix.sky_mtx,
    geometry=flatten(geometry),
    context=flatten(context),
    grid_size=grid_size,
    offset_dist=Slider(0.2, range=0..1),
    legend_par=legendpar,
    run=run)  # -> report, points, results, total, mesh, legend, title, int_mtx; plug-in component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
legend = ClusterOutput(incidentradiation.legend)
results = ClusterOutput(incidentradiation.results)
mesh = ClusterOutput(incidentradiation.mesh)
points = ClusterOutput(incidentradiation.points)

# ==== cluster RadiationSimulation
colrange = LBColorRange(index=Slider(0, range=0..100))  # -> colors; plug-in component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
sky_mtx = ClusterInput()
geometry = ClusterInput()
context = ClusterInput()
run = ClusterInput()
legendpar = LBLegendParameters(colors=colrange)  # -> leg_par; plug-in component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
incidentradiation = LBIncidentRadiation(
    sky_mtx=sky_mtx,
    geometry=flatten(geometry),
    context=flatten(context),
    grid_size=Slider(1, range=0..1),
    offset_dist=Slider(0.2, range=0..1),
    legend_par=legendpar,
    run=run)  # -> report, points, results, total, mesh, legend, title, int_mtx; plug-in component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
legend = ClusterOutput(incidentradiation.legend)
mesh = ClusterOutput(incidentradiation.mesh)
