# Grasshopper definition reading_3D_model.ghx (Grasshopper 1.0.8)
# plug-ins: RhinoCodePluginGH

compas = Python3Script()  # -> out
# ---------- compas: Python ----------
import compas
print(compas.__version__)
# ---------- end compas ----------

# ----
# Generate brick parts
part = Python3Script()  # -> out, brick_full, brick_insulated, brick_half, brick_air_dried
# ---------- part: Python ----------
import os
from compas.geometry import Frame, Box
from compas.datastructures import Mesh
from climate_active_envelopes.assembly import CAEPart as Part



#brick_full
length, width, height = 0.24, 0.115, 0.071
brick_full = Part.from_dimensions(name = "brick_full", length=length, width=width, height=height)
#brick_full.gripping_frame

brick_air_dried = Part.from_dimensions(name = "brick_air_dried", length=length, width=width, height=height)


#brick_insulated_placeholder_new
length, width, height = 0.24, 0.115, 0.071
brick_insulated = Part.from_dimensions(name = "brick_insulated", length=length, width=width, height=height)



# #brick_insulated_placeholder
# length, width, height = 0.245, 0.12, 0.075
# brick_insulated = Part.from_dimensions(length=length, width=width, height=height)
# brick_insulated.attributes['name'] = "brick_insulated"
# print(brick_insulated.__data__)

#corner brick
length, width, height = 0.24, 0.0575, 0.071
brick_half = Part.from_dimensions(name = "brick_half", length=length, width=width, height=height)
#print(brick_half.__data__)

#brick_insulated
# package_path = ghdoc.Path
# data_path = os.path.abspath(os.path.join(package_path,"../../../climate_active_envelopes/data/brick_types"))
# filename = 'brick_insulated_reduced.stl'
# brick_insulated_mesh = Mesh.from_stl(os.path.join(data_path, filename))
# brick_insulated = Part.from_mesh_and_frame(brick_insulated_mesh)
# brick_insulated.attributes['name'] = "brick_insulated"
# #print(brick_insulated.__data__)
# ---------- end part ----------
list = ValueList({"none", "full", "insulated", "half"}, selected="full")
draw = Python3Script(brick_full=part.brick_full, brick_insulated=part.brick_insulated, brick_half=part.brick_half, show=list)  # -> M, P, GP
# ---------- draw: Python ----------
from compas_rhino.conversions import mesh_to_rhino, box_to_rhino, frame_to_rhino
from climate_active_envelopes.assembly import CAEPart as Part
from compas.geometry import Frame
from compas.geometry import Vector
from compas.geometry import Box


if show=="full":

    #extract the mesh of the part for visulization
    compas_mesh_full = brick_full.mesh

    #convert to rhino mesh
    M = mesh_to_rhino(compas_mesh_full)

    #extract and convert to rhino plane
    P = frame_to_rhino(brick_full.frame)
    GP = frame_to_rhino(brick_full.gripping_frame)

    #print(full_brick.__data__)
    #print(type(brick_full))

    
elif show == "insulated":
    
    #extract the mesh of the part for visulization
    compas_mesh_insulated = brick_insulated.mesh

    #convert to rhino mesh
    M = mesh_to_rhino(compas_mesh_insulated)
    
    #extract and convert to rhino plane
    P = frame_to_rhino(brick_insulated.frame)
    GP = frame_to_rhino(brick_insulated.gripping_frame)

elif show == "half":

    #extract the mesh of the part for visulization
    compas_mesh_half = brick_half.mesh

    #convert to rhino mesh
    M = mesh_to_rhino(compas_mesh_half)
    
    #extract and convert to rhino plane
    P = frame_to_rhino(brick_half.frame)
    GP = frame_to_rhino(brick_half.gripping_frame)
else:
    pass
# ---------- end draw ----------
mesh = Mesh(draw.M)
pln = Plane([draw.P, draw.GP])

# ----
# Unload Python modules
# Reading 3D Model
button = Button()
unload = Python3Script(unload=button)  # -> out, a
# ---------- unload: Python ----------
#from compas_ghpython.utilities import unload_modules
from compas_rhino import unload_modules

unload_modules('climate_active_envelopes')
unload_modules('assembly_information_model')
# ---------- end unload ----------

compas___version = Panel(compas)

# ----
# Create empty Assembly
button_2 = Button()
assembly = Python3Script(init=button_2)  # -> out, my_assembly
# ---------- assembly: Python ----------
from climate_active_envelopes.assembly import CAEAssembly as Assembly

#create empty assembly
my_assembly = Assembly()
print(my_assembly)
# ---------- end assembly ----------

bricks_rotating = Brep([<brep referenced from the Rhino model> x218])
bricks_translating = Brep([<brep referenced from the Rhino model> x217])
bricks_fixed = Brep([<brep referenced from the Rhino model> x530])
bricks_insulated = Brep([<brep referenced from the Rhino model> x1020])
bricks_half = Brep([<brep referenced from the Rhino model> x15])
bricks_air_dried = Brep([<brep referenced from the Rhino model> x155])

list_2 = ValueList({"rotate", "translate"}, selected="rotate")
list_3 = ValueList({"clockwise": "right", "counter clockwise": "left"}, selected="clockwise")
transform = Button()
reset = Button()

bricks_insulated_arch = Brep([<brep referenced from the Rhino model> x21])
bricks_arch = Brep([<brep referenced from the Rhino model> x21])

bricks_cut_rotating = Brep([<brep referenced from the Rhino model> x11])
bricks_cut_translating = Brep([<brep referenced from the Rhino model> x8])
bricks_cut_insulated = Brep([<brep referenced from the Rhino model> x56])

bricks_cut_fixed = Brep([<brep referenced from the Rhino model> x33])

# ----
# Generate brick assembly
boolean_toggle = BooleanToggle(True)
add_bricks = Python3Script(
    compute=boolean_toggle,
    my_assembly=assembly.my_assembly,
    bricks_rotating=bricks_rotating,
    bricks_translating=bricks_translating,
    bricks_fixed=bricks_fixed,
    bricks_insulated=bricks_insulated,
    bricks_half=bricks_half,
    bricks_air_dried=bricks_air_dried,
    brick_full=part.brick_full,
    brick_insulated=part.brick_insulated,
    brick_half=part.brick_half,
    brick_air_dried=part.brick_air_dried)  # -> out, my_assembly; inputs bricks_rotating: list of Brep, bricks_translating: list of Brep, bricks_fixed: list of Brep, bricks_insulated: list of Brep, bricks_half: list of Brep, bricks_air_dried: list of Brep
# ---------- add_bricks: Python ----------
my_assembly.set_brick_params(brick_full, brick_insulated, brick_half, brick_air_dried)


if compute == True:
    #my_assembly.read_model_to_assembly(bricks_rotating, "brick_full", "rotate")
    #my_assembly.read_model_to_assembly(bricks_translating, "brick_full", "translate")
    my_assembly.read_model_to_assembly(bricks_fixed, "brick_full", "fixed")
    my_assembly.read_model_to_assembly(bricks_insulated, "brick_insulated", "fixed")
    my_assembly.read_model_to_assembly(bricks_half, "brick_half", "fixed")
    my_assembly.read_model_to_assembly(bricks_air_dried, "brick_air_dried", "fixed")
    
  
print(my_assembly)
# ---------- end add_bricks ----------
add_meshes = Python3Script(
    my_assembly=add_bricks.my_assembly,
    bricks_cut_rotating=bricks_cut_rotating,
    bricks_cut_translating=bricks_cut_translating,
    bricks_cut_insulated=bricks_cut_insulated,
    bricks_cut_fixed=bricks_cut_fixed)  # -> out, my_assembly; inputs bricks_cut_rotating: list of Mesh, bricks_cut_translating: list of Mesh, bricks_cut_insulated: list of Mesh, bricks_cut_fixed: list of Mesh
# ---------- add_meshes: Python ----------
from climate_active_envelopes.assembly import CAEPart as Part
from compas_rhino.conversions import  mesh_to_compas


# for m in bricks_cut_rotating:
#     mesh = mesh_to_compas(m)
#     rotating_cut = Part.from_mesh_and_frame(mesh)
#     my_assembly.add_part_from_model(rotating_cut, attr_dict={"brick_type": "rotating_cut", "transform_type": "fixed"})

# for m in bricks_cut_translating:
#     mesh = mesh_to_compas(m)
#     translating_cut = Part.from_mesh_and_frame(mesh)
#     my_assembly.add_part_from_model(translating_cut, attr_dict={"brick_type": "translating_cut", "transform_type": "translate"})

for m in bricks_cut_insulated:
    mesh = mesh_to_compas(m)
    insulated_cut = Part.from_mesh_and_frame(mesh)
    my_assembly.add_part_from_model(insulated_cut, attr_dict={"brick_type": "insulated_cut", "transform_type": "fixed"})  

for m in bricks_cut_fixed:
    mesh = mesh_to_compas(m)
    insulated_cut = Part.from_mesh_and_frame(mesh)
    my_assembly.add_part_from_model(insulated_cut, attr_dict={"brick_type": "fixed_cut", "transform_type": "fixed"})
# ---------- end add_meshes ----------
interfaces = Python3Script(my_assembly=add_meshes.my_assembly, show_intersections=Toggle(True))  # -> out, my_assembly, meshes
# ---------- interfaces: Python ----------
from compas.geometry import Polygon, Point
from compas_rhino.conversions import mesh_to_rhino
from shapely.geometry import Polygon as ShapelyPolygon



courses = my_assembly.assembly_courses()
#print(courses)
#sorted_parts = [part for course in courses for part in course]



polygons = my_assembly.project_part_faces(courses)    
intersections = my_assembly.compute_polygon_intersections(polygons, courses)
transformed_intersections = my_assembly.transform_intersections_to_original_course(intersections, courses)
#transformed_intersections = my_assembly.transform_intersections_to_course_above(intersections, courses)
my_assembly.set_interface_points()

# Convert transformed intersections to meshes
meshes = []
if show_intersections:

    for key, intersection in transformed_intersections.items():
        mesh = intersection.to_mesh()
        rhino_mesh = mesh_to_rhino(mesh)
        meshes.append(rhino_mesh)




# def project_part_faces(courses):
#     courses = my_assembly.assembly_courses()
#     sorted_parts = [part for course in courses for part in course]
#     polygons = {}
#     for part in sorted_parts:
#         frame_point = my_assembly.graph.node_attributes(part, 'xyz')
#         part = my_assembly.part(part)
#         for face in part.mesh.faces():
#             face_vertices = part.mesh.face_vertices(face)
#             face_coords = [part.mesh.vertex_coordinates(vkey) for vkey in face_vertices]
#             if all(coord[2] == frame_point[2] for coord in face_coords):
#                 target_face = face
#         face_vertices = part.mesh.face_vertices(target_face)
#         vertices = [part.mesh.vertex_coordinates(vkey) for vkey in face_vertices]
#         projected_vertices = [(x, y) for x, y, z in vertices]
#         polygon = Polygon(projected_vertices)
#         polygons[part.key] = polygon
#     return polygons


# def compute_polygon_intersections(polygons, courses):
#     intersections = {}
#     for i in range(len(courses) - 1):
#         current_course = courses[i]
#         next_course = courses[i + 1]
#         for part in current_course:
#             part_polygon = polygons[part]
#             for neighbor in next_course:
#                 neighbor_polygon = polygons[neighbor]
#                 # Convert compas polygons to shapely polygons
#                 shapely_part_polygon = ShapelyPolygon([(point.x, point.y) for point in part_polygon.points])
#                 shapely_neighbor_polygon = ShapelyPolygon([(point.x, point.y) for point in neighbor_polygon.points])
#                 # Compute intersection
#                 intersection = shapely_part_polygon.intersection(shapely_neighbor_polygon)
#                 if not intersection.is_empty:
#                     # Convert shapely intersection back to compas polygon
#                     intersection_coords = list(intersection.exterior.coords)
#                     intersection_points = [Point(x, y, part_polygon.points[0].z) for x, y in intersection_coords]
#                     intersections[(part, neighbor)] = Polygon(intersection_points)
#     return intersections


# def transform_intersections_to_original_course(intersections, courses):
#     transformed_intersections = {}
#     for (part, neighbor), intersection in intersections.items():
#         part_course = next(i for i, course in enumerate(courses) if part in course)
#         neighbor_course = next(i for i, course in enumerate(courses) if neighbor in course)
#         if part_course < neighbor_course:
#             z_coord = my_assembly.graph.node_attribute(part, 'z')
#             transformed_intersection_points = [Point(p.x, p.y, z_coord) for p in intersection.points]
#             transformed_intersections[(part, neighbor)] = Polygon(transformed_intersection_points)
#         else:
#             z_coord = my_assembly.graph.node_attribute(neighbor, 'z')
#             transformed_intersection_points = [Point(p.x, p.y, z_coord) for p in intersection.points]
#             transformed_intersections[(neighbor, part)] = Polygon(transformed_intersection_points)

#         attr = {
#         'interface_type': 'face_face',
#         'interface_points': [(point.x, point.y, point.z) for point in transformed_intersection_points],
#         }
#         my_assembly.graph.add_edge(part, neighbor, attr_dict=attr)

#     return transformed_intersections

# def transform_intersections_to_course_above(intersections, courses):
#     transformed_intersections = {}
#     for (part, neighbor), intersection in intersections.items():
#         neighbor_course = next(i for i, course in enumerate(courses) if neighbor in course)
#         z_coord = my_assembly.graph.node_attribute(neighbor, 'z')
#         transformed_intersection_points = [Point(p.x, p.y, z_coord) for p in intersection.points]
#         transformed_intersections[(part, neighbor)] = Polygon(transformed_intersection_points)

#         attr = {
#             'interface_type': 'face_face',
#             'interface_points': [(point.x, point.y, point.z) for point in transformed_intersection_points],
#         }
#         my_assembly.graph.add_edge(part, neighbor, attr_dict=attr)

#     return transformed_intersections


# def set_interface_points(my_assembly):
#     for key in my_assembly.graph.nodes():
#         part = my_assembly.part(key)
#         frame_point = my_assembly.graph.node_attributes(key, 'xyz')
#         part = my_assembly.part(key)
#         for face in part.mesh.faces():
#             face_vertices = part.mesh.face_vertices(face)
#             face_coords = [part.mesh.vertex_coordinates(vkey) for vkey in face_vertices]
#             if all(coord[2] == frame_point[2] for coord in face_coords):
#                 target_face = face
#         face_vertices = part.mesh.face_vertices(target_face)
#         vertices = [part.mesh.vertex_coordinates(vkey) for vkey in face_vertices]
#         projected_vertices = [(x, y) for x, y, z in vertices]
#         polygon = Polygon(projected_vertices)
#         my_assembly.graph.node_attribute(key, 'interface_points', projected_vertices)
# ---------- end interfaces ----------
add_arch_bricks = Python3Script(my_assembly=interfaces.my_assembly, bricks_arch=bricks_arch, bricks_insulated_arch=bricks_insulated_arch)  # -> out, my_assembly; inputs bricks_arch: list of Brep, bricks_insulated_arch: list of Brep
# ---------- add_arch_bricks: Python ----------
my_assembly.read_model_to_assembly(bricks_arch, "brick_full", "fixed")
my_assembly.read_model_to_assembly(bricks_insulated_arch, "brick_insulated", "fixed")
# ---------- end add_arch_bricks ----------
mesh_2 = Mesh(interfaces.meshes)

# ----
# Apply Gradient
values = Python3Script(min_value=Slider(0, range=-0.4..0.1), max_value=Slider(0.5, range=-0.5..1))  # -> normalized_values; inputs results: list
# ---------- values: Python ----------
from compas.itertools import normalize_values



def normalize_to_highest(values, max_value=140.0, target_min=0.1, target_max=1):
    """Normalizes a list of values based on the highest value in the list, 
    scaled to a specific range.

    Args:
    values: A list of numerical values.
    max_value: The expected maximum value. Defaults to 140.0.
    target_min: The minimum value of the target range. Defaults to 0.0.
    target_max: The maximum value of the target range. Defaults to 1.0.

    Returns:
    A list of normalized values.
    """
    highest_value = max(values)

    factor = highest_value / max_value
    print(factor)  # Calculate the scaling factor
    normalized_values = normalize_values(values, target_min, target_max * factor)
    return normalized_values

normalized_values = normalize_values(results, min_value, max_value)
#normalized_values = normalize_to_highest(results)
#print(color_values)

print(max(normalized_values))

print(normalized_values)
# ---------- end values ----------
keys = Python3Script(my_assembly=add_arch_bricks.my_assembly, transform_type=list_2)  # -> out, my_assembly, keys; inputs transform_type: String
# ---------- keys: Python ----------
# for node_id in my_assembly.graph.nodes():
#     transform_type = my_assembly.graph.node_attribute(node_id, 'transform_type')





keys = []
for key in my_assembly.graph.nodes_where({"transform_type": transform_type}):
    keys.append(key)

print(keys)
print(transform_type)
# ---------- end keys ----------
apply_gradient = Python3Script(
    my_assembly=keys.my_assembly,
    normalized_values=values,
    keys=keys.keys,
    transform_type=list_2,
    rotation_direction=list_3,
    nrbh_size=Slider(2000, range=2..2000),
    transform=transform,
    reset=reset)  # -> out, my_assembly; inputs normalized_values: list, pts: list of Point3d, keys: list, nrbh_size: Int32
# ---------- apply_gradient: Python ----------
from compas_rhino.conversions import point_to_compas



#print(my_assembly.__data__)

transform_types = {node_id: my_assembly.graph.node_attribute(node_id, 'transform_type') for node_id in my_assembly.graph.nodes()}
#print(transform_types)
points = []
for p in pts:
    point = point_to_compas(p)
    points.append(point)

if transform:
    my_assembly.apply_gradient(normalized_values,points,keys,transform_type, rotation_direction, nrbh_size, reset=False)

if reset:
    my_assembly.apply_gradient(normalized_values,points,keys,transform_type, rotation_direction, nrbh_size, reset=True)
# ---------- end apply_gradient ----------

compute = Button()
clear = Button()

y_axis = Curve(<curve referenced from the Rhino model>)
# Generate assembly patches
x_axis = Curve(<curve referenced from the Rhino model>)
plane = Python3Script(plane_axes=[x_axis, y_axis])  # -> out, plane, sphere; inputs plane_axes: list of Curve
# ---------- plane: Python ----------
import Rhino.Geometry as rg
from compas_rhino.conversions import  plane_to_compas_frame, sphere_to_rhino
from compas.geometry import Sphere

x_axis, y_axis = plane_axes



x_axis = rg.Line(x_axis.PointAtStart, x_axis.PointAtEnd)
y_axis = rg.Line(y_axis.PointAtStart, y_axis.PointAtEnd)

if x_axis.From.DistanceTo(y_axis.From) < 0.01:
    origin = x_axis.From
    xvec = x_axis.Direction
    yvec = y_axis.Direction
elif x_axis.To.DistanceTo(y_axis.To) < 0.01:
    origin = x_axis.To
    xvec = -x_axis.Direction
    yvec = -y_axis.Direction
elif x_axis.From.DistanceTo(y_axis.To) < 0.01:
    origin = x_axis.From
    xvec = x_axis.Direction
    yvec = -y_axis.Direction
elif x_axis.To.DistanceTo(y_axis.From) < 0.01:
    origin = x_axis.To
    xvec = -x_axis.Direction
    yvec = y_axis.Direction

plane = rg.Plane(origin, xvec, yvec)

compas_sphere = Sphere(frame = plane_to_compas_frame(plane), radius=1.5)
sphere = sphere_to_rhino(compas_sphere)
# ---------- end plane ----------
geo = Geometry(plane.sphere)
preview = CustomPreview(Geometry=geo, Material=ColourSwatch(SwatchColor=RGBA(131, 85, 57, 8)))

show_all = BooleanToggle(False)
show_connections = BooleanToggle(False)
show_until_key = BooleanToggle(False)
show_course = BooleanToggle(False)
show_neighbors = BooleanToggle(False)
show_patch = BooleanToggle(False)
show_patch_until_counter = BooleanToggle(True)
show_patches = BooleanToggle(True)
highlight_current_part = BooleanToggle(False)

step = Button()
back = Button()
reset_2 = Button()

start = Button()
stop = Button()
step_2 = Button()
back_2 = Button()
reset_3 = Button()
full = Button()
list_4 = ValueList({"20", "50", "100", "500", "1000", "5000"}, selected="50")

# ----
# Import to JSON
import = Button(ExpressionNormal="True", ExpressionPressed="False")
list_5 = ValueList({"assembly": "assembly_full.json"}, selected="assembly")
path = Python3Script()  # -> HERE, DATA
# ---------- path: Python ----------
import os

HERE = os.path.dirname(ghdoc.Path)
DATA = os.path.abspath(os.path.join(HERE, "..", "data"))
print(HERE)
print(DATA)
# ---------- end path ----------
initial_assembly = Python3Script(DATA=path.DATA, filename=list_5, import_from_json=import)  # -> out, assembly
# ---------- initial_assembly: Python ----------
import os
import json

from climate_active_envelopes.assembly import CAEAssembly as Assembly
from climate_active_envelopes.assembly import CAEPart as Part

#assembly = Assembly()

if import_from_json:
    filename = filename
    PATH = os.path.join(DATA, "assembly", filename)
    print(PATH)
    assembly = Assembly.from_json(PATH)
    print(assembly)
# ---------- end initial_assembly ----------

sequences = Python3Script(assembly=add_arch_bricks.my_assembly, plane=plane.plane, compute_sequence_in_reach=compute, clear_sequ=clear)  # -> out, assembly; inputs plane: Plane
# ---------- sequences: Python ----------
from compas.geometry import Point
from compas_rhino.conversions import  plane_to_compas_frame
from scriptcontext import sticky as st



# store data in component
guid = str(ghenv.Component.InstanceGuid)
patch_num_key  = "patch_num_" + guid

if patch_num_key not in st:
    st[patch_num_key] = 1

frame = plane_to_compas_frame(plane)

def get_nbrs_under(key):
    nbrs = assembly.graph.neighbors(key)
    #key_z = assembly.graph.node_attribute(key, "z")
    nbrs_under = [n for n in nbrs if assembly.graph.node_attribute(n, "course")<assembly.graph.node_attribute(key, "course")]
    return nbrs_under

# def get_nbrs_above(key):
#     nbrs = assembly.graph.neighbors(key)
#     nbrs_above = [n for n in nbrs if assembly.graph.node_attribute(n, "course") > assembly.graph.node_attribute(key, "course")]
#     return nbrs_above

def is_node_satisfied(key):
    nbrs_under = get_nbrs_under(key)
    if len(nbrs_under):
        for n in nbrs_under:
            if assembly.graph.node_attribute(n, "used") == False:
                return False
    print(f"Node {key} is satisfied.")
    return True


def dist_to_frame(key, frame):
    part_origin = assembly.part(key).frame
    ro = frame.point
    # ro = robot_origin.point
    #ro_mirror = Point(ro.x, -(ro.y)-0.2, -ro.z-0.35)
    ro_mirror = Point(ro.x, -(ro.y)-0.2, ro.z-0.35)
    dist = ro_mirror.distance_to_point(part_origin.point)
    return dist

def compute_all_in_reach():
    keys = list(assembly.graph.nodes_where({"used": False}))
    keys_in_patch = []
    #frame = plane_to_compas_frame(plane)
    for key in keys:
        dist = dist_to_frame(key, frame)
        if dist < 1.5 and is_node_satisfied(key): # first row: 1.15, second row 1.50
            keys_in_patch.append(key)
            assembly.graph.node_attribute(key, 'used', True)
    return keys_in_patch

if clear_sequ:
    assembly.graph.nodes_attribute(name='used', value=0)
    assembly.graph.nodes_attribute(name='patch', value=0)
    st[patch_num_key] = 1
    assembly.graph.attributes['patch_num'] = st[patch_num_key] 

if compute_sequence_in_reach:
    keys_in_patch = []
    while True:
        new_keys = compute_all_in_reach()
        if not new_keys:
            break
        keys_in_patch.extend(new_keys)
    print(f"Keys in Patch: {keys_in_patch}")
    assembly.graph.nodes_attribute(name='patch', value=st[patch_num_key], keys=keys_in_patch)
    
    #assembly.graph.attributes['patch_num'] = st[patch_num_key] 

    patch_data = {
        'patch_number': st[patch_num_key],
        'parts': {}  # Store part data here
    }

    for key in keys_in_patch:
        part_attributes = assembly.graph.node_attributes(key=key)
        patch_data['parts'][key] = part_attributes

    assembly.graph.attributes['patch_num'] = patch_data
    st[patch_num_key] += 1
# ---------- end sequences ----------

counter = Python3Script(
    my_assembly=sequences.assembly,
    start=start,
    stop=stop,
    step=step_2,
    step_back=back_2,
    reset=reset_3,
    full=full,
    interval=list_4)  # -> out, node_key, counter
# ---------- counter: Python ----------
from scriptcontext import sticky as st
import Grasshopper

courses = my_assembly.assembly_courses(tol= 0.0001)
#courses = my_assembly.assembly_courses_xy(tol= 0.0001)
#courses = (my_assembly.assembly_courses_xyz(tol= 0.0001, z_tol = 0.1))


L = [node for course in courses for node in course]
# print(L)



def update_component(ghenv, delay):
    """Schedule an update of the Grasshopper component.

    After the specified delay, the GH component will be automatically updated.

    Parameters
    ----------
    ghenv : :class:`GhPython.Component.PythonEnvironment`
        The current GHPython environment.
    delay : :obj:`int`
        Time in milliseconds until the update is performed.

    Raises
    ------
    ValueError
        If the delay is less than zero.

    """
    if delay <= 0:
        raise ValueError("Delay must be greater than zero")

    ghcomp = ghenv.Component
    ghdoc = ghcomp.OnPingDocument()

    def callback(ghdoc):
        if ghdoc.SolutionState != Grasshopper.Kernel.GH_ProcessStep.Process:
            ghcomp.ExpireSolution(False)

    ghdoc.ScheduleSolution(delay, Grasshopper.Kernel.GH_Document.GH_ScheduleDelegate(callback))




guid = str(ghenv.Component.InstanceGuid)
counter_key = "counter_" + guid
running_key = "running_" + guid

if counter_key not in st:
    st[counter_key] = 0

if running_key not in st:
    st[running_key] = False

if st[running_key]:
    if st[counter_key] < len(L) - 1:
        st[counter_key] += 1
        update_component(ghenv, interval)
    else:
        st[counter_key] = 0
        st[running_key] = False

if start:
    st[running_key] = True

if stop:
    st[running_key] = False

if step:
    if st[counter_key] < len(L) - 1:
        st[counter_key] += 1

if step_back:
    if st[counter_key] < len(L) - 1:
        st[counter_key] -= 1

if reset:
    st[counter_key] = 0
    st[running_key] = False

if full:
    st[counter_key] = len(L) - 1

if len(L):
    node_key = L[st[counter_key]]
    print(f"Current node item: {node_key}")

#st["visualisation_counter"] = st[counter_key]
counter = st[counter_key] + 1

print(L)
# ---------- end counter ----------
panel = Panel(counter.counter)

list_6 = ValueList({"1", "2", "3", "4", "5", "6", "7", "8", "9"}, selected="9")
visualize = Python3Script(
    my_assembly=sequences.assembly,
    show_all=show_all,
    show_connections=show_connections,
    show_until_key=show_until_key,
    show_course=show_course,
    show_neighbors=show_neighbors,
    show_patch=show_patch,
    show_patch_until_counter=show_patch_until_counter,
    show_patches=show_patches,
    highlight_current_part=highlight_current_part,
    node_key=counter.node_key,
    step=step,
    step_back=back,
    reset=reset_2,
    patch_idx=list_6)  # -> out, parts_geometry, brick_full_geometry, brick_insulated_geometry, brick_air_dried_geometry, parts_frame, current_part_geometry, current_part_frame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; inputs patch_idx: Int32
# ---------- visualize: Python ----------
from compas_rhino.conversions import mesh_to_rhino, box_to_rhino, frame_to_rhino
from compas.colors import Color
import Rhino.Geometry as rg
import ghpythonlib.components as ghcomp
from scriptcontext import sticky as st

courses = my_assembly.assembly_courses(tol= 0.0001)

#courses = my_assembly.assembly_courses_xyz(tol= 0.0001, z_tol = 0.1)
#courses = my_assembly.assembly_courses_xy(tol= 0.0001)

L = [node for course in courses for node in course]


G_neighbors = []
G_connections = []
G_course = []
G_patch = []
G_patches =  []
G_sequence_wtop_key = []
G_patches_color = []


key_index = my_assembly.graph.node_index()
keys = [key_index[key] for key in my_assembly.graph.nodes()]
#key = node_key

#get parts datastructure
parts = [p for p in my_assembly.parts()]
brick_full_parts = [p for p in parts if my_assembly.graph.node_attribute(p.key, "brick_type") == "brick_full"]
brick_insulated_parts = [p for p in parts if my_assembly.graph.node_attribute(p.key, "brick_type") == "brick_insulated"]
brick_air_dried_parts = [p for p in parts if my_assembly.graph.node_attribute(p.key, "brick_type") == "brick_air_dried"]

if show_all:

    brick_full_geometry = []
    brick_insulated_geometry = []
    brick_air_dried_geometry = []
    parts_frame = []

    parts_geometry = [mesh_to_rhino(p.mesh) for p in parts]
    brick_full_geometry = [mesh_to_rhino(p.mesh) for p in brick_full_parts]
    brick_insulated_geometry = [mesh_to_rhino(p.mesh) for p in brick_insulated_parts]
    brick_air_dried_geometry = [mesh_to_rhino(p.mesh) for p in brick_air_dried_parts]

    parts_frame = [frame_to_rhino(p.frame) for p in parts]
    key = my_assembly.graph.number_of_nodes()-1

if show_connections:
    edges = list(my_assembly.connections())
    for e in edges:
        part1 = my_assembly.part(e[0])
        part2 = my_assembly.part(e[1])
        if not hasattr(part1.frame, 'point') or not hasattr(part2.frame, 'point'):
            print(f"Missing frame point for edge: {e}")
            continue
        p1 = part1.frame.point
        p2 = part2.frame.point
        G_connections += [rg.Line(p1[0], p1[1], p1[2], p2[0], p2[1], p2[2])]

        # p1 = my_assembly.part(e[0]).frame.point
        # p2 = my_assembly.part(e[1]).frame.point
        # G_connections += [rg.Line(p1[0],p1[1],p1[2],p2[0],p2[1],p2[2])]

if show_neighbors:
    nbrs = [key_index[key] for key in my_assembly.graph.neighbors(key=node_key)]
    parts = [my_assembly.part(key) for key in nbrs]
    for p in parts:
        G_neighbors.append(mesh_to_rhino(p.mesh))

if show_course:
    total_courses = max(my_assembly.graph.nodes_attribute('course')) + 1
    course = my_assembly.graph.node_attribute(key=node_key, name='course')
    keys_in_course = list(my_assembly.graph.nodes_where({'course': course}))
    parts = [my_assembly.part(key) for key in keys_in_course]
    for p in parts:
        G_course.append(mesh_to_rhino(p.mesh))

if show_until_key:
    current_index = L.index(node_key)
    parts_geometry = [mesh_to_rhino(parts[key].mesh) for key in L[:current_index + 1]]
    parts_frame = [frame_to_rhino(parts[key].frame) for key in L[:current_index + 1]]
    key = node_key

if show_patch:
    c_max = max(my_assembly.graph.nodes_attribute(name='patch'))
    keys_in_patch = list(my_assembly.graph.nodes_where({'patch': patch_idx}))
    L_patch = [node for course in courses for node in course if node in keys_in_patch]

    guid = str(ghenv.Component.InstanceGuid)
    counter_key = "counter_" + guid
    running_key = "running_" + guid
    if counter_key not in st:
        st[counter_key] = 0
    if step:
        if st[counter_key] < len(L_patch) - 1:
            st[counter_key] += 1
    if step_back:
        if st[counter_key] < len(L_patch) - 1:
            st[counter_key] -= 1
    if reset:
        st[counter_key] = 0
    if len(L_patch):
        patch_key = L_patch[st[counter_key]]
        print(f"Current node item: {patch_key}")
    if show_patch_until_counter:
        current_index = L_patch.index(patch_key)
        parts = [mesh_to_rhino(my_assembly.part(key).mesh) for key in L_patch[:current_index + 1]]
    else:
        parts = [mesh_to_rhino(my_assembly.part(key).mesh) for key in keys_in_patch]
    for p in parts:
        G_patch.append(p)
    key = patch_key

    # if show_sequence_wtop_key:
    #     #key = 100
    #     sequ = my_assembly.assembly_building_sequence(patch_key)
    #     print(sequ)
    #     parts = [my_assembly.part(patch_key) for patch_key in sequ]
    #     for p in parts:
    #         G_sequence_wtop_key.append(mesh_to_rhino(p.mesh))
    # key = patch_key



if show_patches:
    c_max = max(my_assembly.graph.nodes_attribute(name='patch')) + 1
    for patch_index in range(1, c_max):
        keys_in_patch = list(my_assembly.graph.nodes_where({'patch': patch_index}))
        parts = [my_assembly.part(key) for key in keys_in_patch]
        for p in parts:
            G_patches.append(mesh_to_rhino(p.mesh))
            color_value = (1 - patch_index / c_max) - 0.2
            color_value = max(0, min(color_value, 1))  # Ensure the color value is within [0, 1]   
            r = int(255 * (3*color_value))
            g = int(255 * (5*color_value))
            b = int(255 * (1.5*color_value))          
            G_patches_color.append(ghcomp.ColourRGB(r, g, b))

        
# if show_nothing:
#     print("Nothing to see")
#     pass


if highlight_current_part:
    current_part = my_assembly.part(key)
    current_part_geometry = mesh_to_rhino(current_part.mesh)
    current_part_frame = frame_to_rhino(current_part.frame)
    current_part_gripping_frame = frame_to_rhino(current_part.gripping_frame)
    print(current_part.__data__)
    
print(my_assembly)
# ---------- end visualize ----------

# ----
# Import to JSON
import_2 = Button(ExpressionNormal="True", ExpressionPressed="False")
list_7 = ValueList({"assembly": "assembly_full_2005.json", "patch_1": "patch_1_2005.json", "patch_2": "patch_2_2005.json", "patch_3": "patch_3_2005.json", "patch_4": "patch_4_2005.json", "patch_5": "patch_5_2005.json", "patch_6": "patch_6_2005.json", "patch_7": "patch_7_2005.json", "patch_8": "patch_8_2005.json", "patch_9": "patch_9_2005.json"}, selected="assembly")
path_2 = Python3Script()  # -> HERE, DATA; same code as path
# patch 1: 261
# patch 2: 242
# patch 3: 238
# patch 4: 468
# patch 5: 336
# patch 6: 183
# patch 7: 26
# patch 9: 73
# patch 9: 14
initial_assembly_2 = Python3Script(DATA=path_2.DATA, filename=list_7, import_from_json=import_2)  # -> out, assembly; same code as initial_assembly

export = Button()
export_2 = Button()

list_8 = ValueList({"patch_1": "patch_1_2005.json", "patch_2": "patch_2_2005.json", "patch_3": "patch_3_2005.json", "patch_4": "patch_4_2005.json", "patch_5": "patch_5_2005.json", "patch_6": "patch_6_2005.json", "patch_7": "patch_7_2005.json", "patch_8": "patch_8_2005.json", "patch_9": "patch_9_2005.json"}, selected="patch_1")

# ----
# Export to JSON
path_3 = Python3Script()  # -> HERE, ASSEMBLY, DATA
# ---------- path_3: Python ----------
import os

HERE = os.path.dirname(ghdoc.Path)
DATA = os.path.abspath(os.path.join(HERE, "..", "data"))
ASSEMBLY = os.path.abspath(os.path.join(DATA, "assembly"))

print(HERE)
print(DATA)
print(ASSEMBLY)
# ---------- end path_3 ----------
export_3 = Python3Script(
    ASSEMBLY=path_3.ASSEMBLY,
    DATA=path_3.DATA,
    filename_patch_data=list_8,
    my_assembly=sequences.assembly,
    export_patch=export,
    export_assembly=export_2)  # -> out; inputs ASSEMBLY: String
# ---------- export_3: Python ----------
import os
import json
from compas.datastructures import Assembly
from scriptcontext import sticky as st
from climate_active_envelopes.assembly import CAEAssembly


# print(my_assembly.graph.nodes_attribute(name='patch', value=st[patch_num_key], keys=keys_in_patch))
if export_patch:
    courses = my_assembly.assembly_courses(tol=0.0001)
    c_max = max(my_assembly.graph.nodes_attribute(name="patch"))
    keys_in_patch = list(my_assembly.graph.nodes_where({"patch": c_max}))
    L_patch = [node for course in courses for node in course if node in keys_in_patch]

    # Create a copy of the graph to modify
    filtered_graph = my_assembly.graph.copy()  
    nodes_to_keep = set(L_patch)

    # Remove nodes and edges not in the specific patch
    for node in list(filtered_graph.nodes()):
        if node not in nodes_to_keep:
            filtered_graph.delete_node(node)

    # Create a temporary assembly for export
    temp_assembly = CAEAssembly()
    temp_assembly.graph = filtered_graph

    # Export the filtered assembly to a JSON file
    filename_patch_data = filename_patch_data
    PATH_assembly = os.path.join(ASSEMBLY, filename_patch_data)
    temp_assembly.to_json(PATH_assembly, pretty=True)
    print(f"Assembly exported to {PATH_assembly}")
    print(temp_assembly)



if export_assembly:
    filename_assembly = "assembly_full_2005.json"
    PATH_assembly = os.path.join(ASSEMBLY, filename_assembly)
    my_assembly.to_json(PATH_assembly, pretty=True)
    print(f"Assembly exported to {PATH_assembly}")
    print(my_assembly)
# ---------- end export_3 ----------

geo_2 = Geometry(visualize.parts_geometry)
geo_3 = Geometry([visualize.brick_full_geometry, visualize.parts_geometry])
geo_4 = Geometry(visualize.current_part_gripping_frame)
geo_5 = Geometry(visualize.G_neighbors)
geo_6 = Geometry(visualize.brick_insulated_geometry)
geo_7 = Geometry([visualize.current_part_geometry, visualize.G_connections, visualize.G_course])
geo_8 = Geometry(visualize.G_patch)
geo_9 = Geometry(visualize.G_patches)
geo_10 = Geometry([visualize.parts_frame, visualize.current_part_frame])
geo_11 = Geometry(visualize.brick_air_dried_geometry)
preview_2 = CustomPreview(Geometry=geo_2, Material=ColourSwatch(SwatchColor=RGB(196, 141, 141)))
preview_3 = CustomPreview(Geometry=geo_3, Material=ColourSwatch(SwatchColor=RGB(196, 141, 141)))  # disabled
preview_4 = CustomPreview(Geometry=geo_6, Material=ColourSwatch(SwatchColor=RGB(177, 142, 141)))  # disabled
preview_5 = CustomPreview(Geometry=geo_11, Material=ColourSwatch(SwatchColor=RGB(204, 160, 144)))  # disabled
preview_6 = CustomPreview(Geometry=geo_10, Material=ColourSwatch(SwatchColor=RGB(255, 125, 157)))
preview_7 = CustomPreview(Geometry=geo_7, Material=ColourSwatch(SwatchColor=RGB(204, 103, 157)))
preview_8 = CustomPreview(Geometry=geo_4, Material=ColourSwatch(SwatchColor=RGB(246, 202, 157)))
preview_9 = CustomPreview(Geometry=geo_5, Material=ColourSwatch(SwatchColor=RGB(246, 131, 141)))
preview_10 = CustomPreview(Geometry=geo_8, Material=ColourSwatch(SwatchColor=RGB(246, 131, 141)))
preview_11 = CustomPreview(Geometry=geo_9, Material=visualize.G_patches_color)

# ----
# Visualisation Dashboard
panel_2 = Panel(visualize.out)
draw_2 = Python3Script(planes=geo_4, scale=Slider(0.2, range=0..1))  # -> out, P, V, C, W; inputs planes: list of Plane
# ---------- draw_2: Python ----------
from System.Drawing import Color

red = Color.FromArgb(255, 0, 0)
green = Color.FromArgb(0, 255, 0)
blue = Color.FromArgb(0, 0, 255)

P = []
V = []
C = []

scale = float(scale)

for plane in planes:
    if not plane:
        continue
    P += [plane.Origin] * 3
    V.append(plane.XAxis * scale)
    V.append(plane.YAxis * scale)
    V.append(plane.ZAxis * scale)
    C += [red, green, blue]

W = 3
# ---------- end draw_2 ----------
vdisex = VectorDisplayEx(Point=draw_2.P, Vector=draw_2.V, Colour=draw_2.C, Width=draw_2.W)

pln_2 = Plane(visualize.current_part_gripping_frame)
origin = Point(Point(11.92859817, -0.7565220575, -0.15))  # disabled

x_axis_2 = Curve(<curve referenced from the Rhino model>)  # disabled
y_axis_2 = Curve(<curve referenced from the Rhino model>)  # disabled
plane_2 = Python3Script(plane_axes=[x_axis_2, y_axis_2])  # -> plane; inputs plane_axes: list of Curve; disabled
# ---------- plane_2: Python ----------
import Rhino.Geometry as rg

x_axis, y_axis = plane_axes



x_axis = rg.Line(x_axis.PointAtStart, x_axis.PointAtEnd)
y_axis = rg.Line(y_axis.PointAtStart, y_axis.PointAtEnd)

if x_axis.From.DistanceTo(y_axis.From) < 0.01:
    origin = x_axis.From
    xvec = x_axis.Direction
    yvec = y_axis.Direction
elif x_axis.To.DistanceTo(y_axis.To) < 0.01:
    origin = x_axis.To
    xvec = -x_axis.Direction
    yvec = -y_axis.Direction
elif x_axis.From.DistanceTo(y_axis.To) < 0.01:
    origin = x_axis.From
    xvec = x_axis.Direction
    yvec = -y_axis.Direction
elif x_axis.To.DistanceTo(y_axis.From) < 0.01:
    origin = x_axis.To
    xvec = -x_axis.Direction
    yvec = y_axis.Direction

plane = rg.Plane(origin, xvec, yvec)
# ---------- end plane_2 ----------

frame = Python3Script(origin=origin)  # -> out, origin_frame; inputs origin: Point3d; disabled
# ---------- frame: Python ----------
import math

import Rhino.Geometry as rg
import ghpythonlib.components as ghcomp

#from compas_ghpython import draw_frame
from compas.geometry import Frame

sp = start_plane



p = rg.Plane(origin, sp.XAxis, sp.YAxis)
frame = Frame(p.Origin, p.XAxis, p.YAxis)

#robot_origin_plane = planes[idx]
#robot_origin_frame = frames[idx]
origin_frame = frame
plane = p
# ---------- end frame ----------

# ----
# Generate buildable patches
button_3 = Button()  # disabled
button_4 = Button()  # disabled
sequences_2 = Python3Script(
    assembly=apply_gradient.my_assembly,
    plane=plane_2,
    origin_frame=frame.origin_frame,
    compute_sequence_in_reach=button_3,
    clear_sequ=button_4)  # -> out, assembly; inputs plane: Plane; disabled
# ---------- sequences_2: Python ----------
from compas.geometry import Point
from compas_rhino.conversions import  plane_to_compas_frame
from scriptcontext import sticky as st


# store data in component
guid = str(ghenv.Component.InstanceGuid)
patch_num = "patch_num_" + guid

if patch_num not in st:
    st[patch_num] = 1


def get_nbrs_under(key):
    nbrs = assembly.graph.neighbors(key)
    #key_z = assembly.graph.node_attribute(key, "z")
    nbrs_under = [n for n in nbrs if assembly.graph.node_attribute(n, "course")<assembly.graph.node_attribute(key, "course")]
    return nbrs_under

# def get_nbrs_above(key):
#     nbrs = assembly.graph.neighbors(key)
#     nbrs_above = [n for n in nbrs if assembly.graph.node_attribute(n, "course") > assembly.graph.node_attribute(key, "course")]
#     return nbrs_above

def is_node_satisfied(key):
    nbrs_under = get_nbrs_under(key)
    if len(nbrs_under):
        for n in nbrs_under:
            if assembly.graph.node_attribute(n, "used") == False:
                return False
    print(f"Node {key} is satisfied.")
    return True

"""def dist_to_frame(key, robot_origin):
    
    element_origin = assembly.element(key).frame
    
    ro = robot_origin.point
    ro_mirror = Point(ro.x, -(ro.y)-0.2, ro.z-0.35)
    print ro_mirror
    
    dist = ro_mirror.distance_to_point(element_origin.point)
    
    return dist"""

def dist_to_frame(key, origin_frame):
    part_origin = assembly.part(key).frame
    ro = origin_frame.point
    # ro = robot_origin.point
    ro_mirror = Point(ro.x, -(ro.y)-0.2, ro.z-0.35)
    dist = ro_mirror.distance_to_point(part_origin.point)
    return dist

def compute_all_in_reach():
    keys = list(assembly.graph.nodes_where({"used": False}))
    keys_in_patch = []
    frame = plane_to_compas_frame(plane)
    for key in keys:
        dist = dist_to_frame(key, frame)
        if dist < 1.8 and is_node_satisfied(key):
            keys_in_patch.append(key)
            assembly.graph.node_attribute(key, 'used', True)
    return keys_in_patch

if clear_sequ:
    assembly.graph.nodes_attribute(name='used', value=0)
    assembly.graph.nodes_attribute(name='patch', value=0)
    st[patch_num] = 1

if compute_sequence_in_reach:
    keys_in_patch = []
    while True:
        new_keys = compute_all_in_reach()
        if not new_keys:
            break
        keys_in_patch.extend(new_keys)
    print(f"Keys in Patch: {keys_in_patch}")
    assembly.graph.nodes_attribute(name='patch', value=st[patch_num], keys=keys_in_patch)
    st[patch_num] += 1
# ---------- end sequences_2 ----------

# ----
# Export to JSON
path_4 = Python3Script()  # -> HERE, DATA, ASSEMBLY; disabled; same code as path_3
export_4 = Button()  # disabled
export_5 = Python3Script(ASSEMBLY=path_4.ASSEMBLY, my_assembly=sequences_2.assembly, export=export_4)  # -> out; inputs ASSEMBLY: String; disabled
# ---------- export_5: Python ----------
import os


    

#print(my_assembly.__data__)
if export:
    #print(DATA)
    filename = "250326_brickwall.json"
    PATH = os.path.join(ASSEMBLY, filename)

    # the assembly has to be serialized such that it can be called from CPython
    my_assembly.to_json(PATH, pretty=True)
    print(my_assembly)
# ---------- end export_5 ----------
