# Grasshopper definition robotic_bricklaying_assembly_design.ghx (Grasshopper 1.0.8)

compas = Python3Script()  # -> out
# ---------- compas: Python ----------
import compas
print(compas.__version__)
# ---------- end compas ----------

# ----
# Unload Python modules
# Brick Assembly & Brick Parts
button = Button()
unload = Python3Script(unload=button)  # -> out, a
# ---------- unload: Python ----------
from compas_rhino import unload_modules

unload_modules('robotic_bricklaying')
unload_modules('assembly_information_model')
# ---------- end unload ----------

compas___version = Panel(compas)

# ----
# Create empty assembly
# datastructure
# initialize an empty
# assembly structure first >>
button_2 = Button()
assembly = Python3Script(init=button_2)  # -> out, my_assembly
# ---------- assembly: Python ----------
from robotic_bricklaying.assembly import CAEAssembly as Assembly

#create empty assembly
my_assembly = Assembly()
# ---------- end assembly ----------

part = Python3Script()  # -> out, brick_full, brick_insulated, brick_half
# ---------- part: Python ----------
import os
from compas.geometry import Frame, Box
from compas.datastructures import Mesh
from robotic_bricklaying.assembly import CAEPart as Part


#brick_full
length, width, height = 0.24, 0.115, 0.075
brick_full = Part.from_dimensions(name = "brick_full", length=length, width=width, height=height)
#brick_full.gripping_frame


print(brick_full.frame)
print(brick_full.attributes)
#print(brick_full.__data__)

# brick_half
length, width, height = 0.24, 0.0575, 0.075
brick_half = Part.from_dimensions(name = "brick_half", length=length, width=width, height=height)

#brick_insulated_placeholder
length, width, height = 0.24, 0.115, 0.075
brick_insulated = Part.from_dimensions(name = "brick_insulated", length=length, width=width, height=height)


# # #brick_insulated
# package_path = ghdoc.Path
# data_path = os.path.abspath(os.path.join(package_path,"../../data/brick_types"))
# print(data_path)
# filename = 'insulated_brick_reduced.stl'
# brick_insulated_mesh = Mesh.from_stl(os.path.join(data_path, filename))
# brick_insulated = Part.from_mesh_and_frame(brick_insulated_mesh)
# brick_insulated.attributes['name'] = "brick_insulated"
# #print(brick_insulated.__data__)
# ---------- end part ----------

# ----
# set your epw file, it is
# provided in the rhino folder >>
# change your context if needed >>
context_input = Brep(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)
epw_file = FilePath("C:\Users\julia\workspace\climate_active_envelopes\rhino\DEU_BY_Munich-Theresienwiese.108650_TMYx.epw")

# ----
# Climatic Simulation to unlock self-shading properties
# manipulate date, time
# and orientation >>
number_slider = Slider(6, range=0..10)
number_slider_2 = Slider(0, range=0..360)

# ----
# change the
# direction for rotating bricks >>
list = ValueList({"rotate", "translate"}, selected="rotate")
list_2 = ValueList({"clockwise": "right", "counter clockwise": "left"}, selected="counter clockwise")
# click here to apply
# or reset the transformation >>
transform = Button()
reset = Button()

list_3 = ValueList({"Flemish bond": "flemish_bond", "Vertical bond": "vertical_bond"}, selected="Flemish bond")
list_4 = ValueList({"Single layer": "single_layer", "Double layer": "double_layer"}, selected="Single layer")
list_5 = ValueList({"Cross": "cross", "Straight": "straight", "Diamond": "diamond", "Diamond 2": "diamond_2"}, selected="Diamond 2")
input_surface = Brep(<brep referenced from the Rhino model>)

# ----
# Shading Simulation
# change the resolution of your shading grid >>
# run the simulation >>
run = BooleanToggle(True)
sun_hours = SunHours(
    start_month=number_slider,
    start_day=Slider(1, range=0..10),
    start_hour=Slider(11, range=0..100),
    end_month=Slider(8, range=0..10),
    end_day=Slider(31, range=0..100),
    end_hour=Slider(16, range=0..100),
    north=number_slider_2,
    geometry=input_surface,
    epw_file=epw_file,
    context=context_input,
    grid_size=Slider(0.04, range=0..0.1),
    run=run)  # -> hoys, location, points, results, sky_mtx, mesh, legend
geo = Geometry(sun_hours.legend)
panel = Panel(geo)

# ----
# Sun Path
# set a point for the
# center of your sun path >>
# change the scale
# of the sun path >>
number_slider_3 = Slider(0.4, range=0..10)
pt = Point(Point(-6.494743299, -6.882496362, 0))
sunpath = LBSunPath(north=number_slider_2, location=sun_hours.location, hoys=sun_hours.hoys, center_pt=pt, scale=number_slider_3)  # -> report, vectors, altitudes, azimuths, hoys, sun_pts, analemma, daily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; plug-in component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
geo_2 = Geometry([sunpath.compass, sunpath.daily, sunpath.analemma, sunpath.legend, sunpath.title, sunpath.sun_pts])

# ----
# vizualize the
# shading grid >>
boolean_toggle = BooleanToggle(True)
visualize = Python3Script(show=boolean_toggle, mesh=sun_hours.mesh)  # -> out, M
# ---------- visualize: Python ----------
if show == True:
    M = mesh
# ---------- end visualize ----------
mesh = Mesh(visualize.M)

start = Button()
stop = Button()
step = Button()
back = Button()
reset_2 = Button()
full = Button()
list_6 = ValueList({"20", "50", "100", "500", "1000", "5000"}, selected="500")

# ----
# Vizualize your
# brick wall here >>>
list_7 = ValueList({"show all": "show_all", "show until key": "show_until_key", "show nothing": "show_nothing"}, selected="show all")

# ----
# Generate brick parts
# vizualize the brick >>
# manipulate the smoothness of the gradient >>
list_8 = ValueList({"none", "full", "insulated", "half"}, selected="none")

show = Show(brick_full=part.brick_full, brick_insulated=part.brick_insulated, brick_half=part.brick_half, show=list_8)  # -> reference_model, M

# ----
# set your input surface >>
# change the bond type
# and the wall system >>
# change the
# ornamentation here >>
# change the gap between
# the bricks in horizontal
# and vertical direction >>
# define the range to normalize
# the silmulation results >>
# select translate or rotate
# to apply the transformation >>
mesh_2 = Mesh(show.M)

# ----
# Create brick assembly
number_slider_4 = Slider(0.015, range=0..0.1)
course_height = Slider(0.087, range=0..1)
create_assembly = Python3Script(
    reference_model=show.reference_model,
    my_assembly=assembly.my_assembly,
    surface=input_surface,
    bond_type=list_3,
    wall_system=list_4,
    ornament=list_5,
    brick_full=part.brick_full,
    brick_insulated=part.brick_insulated,
    brick_half=part.brick_half,
    brick_spacing=number_slider_4,
    course_height=course_height)  # -> out, my_assembly; inputs surface: Surface, brick_spacing: Double, course_height: Double
# ---------- create_assembly: Python ----------
from compas_rhino.conversions import surface_to_compas_mesh


mesh = surface_to_compas_mesh(surface, 1)

my_assembly.set_brick_params(brick_full, brick_insulated, brick_half)


input_type = "mesh"
if input_type == "mesh":
    input_data = mesh

my_assembly.generate_wall(reference_model,
                    bond_type, 
                    ornament,
                    wall_system,  
                    brick_spacing, 
                    course_height,
                    input_type,
                    input_data
                    )
# ---------- end create_assembly ----------

# ----
# Apply Gradient
values = Python3Script(results=sun_hours.results, min_value=Slider(0.1, range=0..0.1), max_value=Slider(0.5, range=0..0.5))  # -> out, normalized_values; inputs results: list
# ---------- values: Python ----------
from compas.itertools import normalize_values


def normalize_to_highest(values, max_value=140.0, target_min=0.1, target_max=1):
    """Normalizes a list of values based on the highest value in the list, 
    scaled to a specific range.

    Args:
    values: A list of numerical values.
    max_value: The expected maximum value. Defaults to 140.0.
    target_min: The minimum value of the target range. Defaults to 0.0.
    target_max: The maximum value of the target range. Defaults to 1.0.

    Returns:
    A list of normalized values.
    """
    highest_value = max(values)

    factor = highest_value / max_value
    print(factor)  # Calculate the scaling factor
    normalized_values = normalize_values(values, target_min, target_max * factor)
    return normalized_values

normalized_values = normalize_values(results, min_value, max_value)
#normalized_values = normalize_to_highest(results)
#print(color_values)

print(max(normalized_values))

print(normalized_values)
# ---------- end values ----------
keys = Python3Script(my_assembly=create_assembly.my_assembly, transform_type=list)  # -> out, my_assembly, keys; inputs transform_type: String
# ---------- keys: Python ----------
keys = []
for key in my_assembly.graph.nodes_where({"transform_type": transform_type}):
    keys.append(key)

print(keys)
print(transform_type)
# ---------- end keys ----------

apply_gradient = Python3Script(
    my_assembly=keys.my_assembly,
    normalized_values=values.normalized_values,
    pts=sun_hours.points,
    keys=keys.keys,
    transform_type=list,
    rotation_direction=list_2,
    nrbh_size=Slider(50, range=3..100),
    transform=transform,
    reset=reset)  # -> out, my_assembly; inputs normalized_values: list, pts: list of Point3d, keys: list, nrbh_size: Int32
# ---------- apply_gradient: Python ----------
from compas_rhino.conversions import point_to_compas

points = []

for p in pts:
    point = point_to_compas(p)
    points.append(point)

if transform:
    my_assembly.apply_gradient(normalized_values,points,keys,transform_type, rotation_direction, nrbh_size, reset = False)

if reset:
    my_assembly.apply_gradient(normalized_values,points,keys,transform_type, rotation_direction, nrbh_size, reset = True)
# ---------- end apply_gradient ----------

# ----
# Visualisation Assembly
counter = Python3Script(
    my_assembly=apply_gradient.my_assembly,
    start=start,
    stop=stop,
    step=step,
    step_back=back,
    reset=reset_2,
    full=full,
    interval=list_6)  # -> out, counter
# ---------- counter: Python ----------
from scriptcontext import sticky as st
import Grasshopper

def update_component(ghenv, delay):
    """Schedule an update of the Grasshopper component.

    After the specified delay, the GH component will be automatically updated.

    Parameters
    ----------
    ghenv : :class:`GhPython.Component.PythonEnvironment`
        The current GHPython environment.
    delay : :obj:`int`
        Time in milliseconds until the update is performed.

    Raises
    ------
    ValueError
        If the delay is less than zero.

    """
    if delay <= 0:
        raise ValueError("Delay must be greater than zero")

    ghcomp = ghenv.Component
    ghdoc = ghcomp.OnPingDocument()

    def callback(ghdoc):
        if ghdoc.SolutionState != Grasshopper.Kernel.GH_ProcessStep.Process:
            ghcomp.ExpireSolution(False)

    ghdoc.ScheduleSolution(delay, Grasshopper.Kernel.GH_Document.GH_ScheduleDelegate(callback))

L = range(my_assembly.graph.number_of_nodes())

# store data in component
guid = str(ghenv.Component.InstanceGuid)
counter_key = "counter_" + guid
running_key = "running_" + guid

if counter_key not in st:
    st[counter_key] = 0

if running_key not in st:
    st[running_key] = False
    

if st[running_key]:
    if st[counter_key] < len(L) - 1:
        st[counter_key] += 1
        update_component(ghenv, interval)
    else:
        st[counter_key] = 0
        st[running_key] = False
    
if start:
    st[running_key] = True

if stop:
    st[running_key] = False

if step:
    if st[counter_key] < len(L) - 1:
        st[counter_key] += 1

if step_back:
    if st[counter_key] < len(L) - 1:
        st[counter_key] -= 1

if reset:
    st[counter_key] = 0
    st[running_key] = False

if full:
    st[counter_key] = len(L)-1

if len(L):
    item = L[st[counter_key]]


#st["visualisation_counter"] = st[counter_key]
counter = st[counter_key]+1
# ---------- end counter ----------
panel_2 = Panel(counter.counter)
visualize_2 = Python3Script(my_assembly=apply_gradient.my_assembly, show=list_7, highlight_current_part=Toggle(True), counter=panel_2)  # -> out, brick_full_geometry, brick_insulated_geometry, parts_geometry, parts_frame, current_part_geometry, current_part_frame
# ---------- visualize_2: Python ----------
from compas_rhino.conversions import mesh_to_rhino, box_to_rhino, frame_to_rhino
import Rhino.Geometry as rg
import ghpythonlib.components as ghcomp
from compas.colors import Color
import os
from compas.geometry import Frame, Box
from compas.datastructures import Mesh


#print assembly
print(my_assembly)
#counter = int(counter)

#get parts datastructure
parts = [p for p in my_assembly.parts()]
connections = []
patches = []
patches_color = []
#get current part
brick_full_parts = [p for p in parts if my_assembly.graph.node_attribute(p.key, "brick_type") == "full"]
brick_insulated_parts = [p for p in parts if my_assembly.graph.node_attribute(p.key, "brick_type") == "insulated"]

if show == "show_all":
    
    #brick_full_parts = [p for p in parts if my_assembly.graph.node_attribute(p.key, "brick_type") == "full"]
    #brick_insulated_parts = [p for p in parts if my_assembly.graph.node_attribute(p.key, "brick_type") == "insulated"]

    brick_full_geometry = []
    brick_insulated_geometry = []
    parts_frame = []

    brick_full_geometry = [mesh_to_rhino(p.mesh) for p in brick_full_parts]
    brick_insulated_geometry = [mesh_to_rhino(p.mesh) for p in brick_insulated_parts]
    
    #extract the frame of the parts for visulization (+ converted to rhino plane)
    parts_frame = [frame_to_rhino(p.frame) for p in parts]

    key = my_assembly.graph.number_of_nodes()-1


if show == "show_until_key":
    #extract the mesh of the parts for visulization (+ converted to rhino mesh)
    parts_geometry = [mesh_to_rhino(p.mesh) for p in parts[0:int(counter)]]
    
    #extract the frame of the parts for visulization (+ converted to rhino plane)
    parts_frame = [frame_to_rhino(p.frame) for p in parts[0:int(counter)]]

    key = int(counter)-1

if show == "show_nothing":
    print("Nothing to see")
    pass


if highlight_current_part:
    current_part = my_assembly.part(key)
    current_part_geometry = mesh_to_rhino(current_part.mesh)
    current_part_frame = frame_to_rhino(current_part.frame)
    current_part_gripping_frame = frame_to_rhino(current_part.gripping_frame)
    
    print(current_part.__data__)
# ---------- end visualize_2 ----------
panel_3 = Panel(visualize_2.out)

# ----
# Radiation Simulation
# run the solar
# radiation simulation >>
run_2 = BooleanToggle(False)
radiation_simulation = RadiationSimulation(sky_mtx=sun_hours.sky_mtx, geometry=visualize_2.brick_full_geometry, context=context_input, run=run_2)  # -> mesh, legend
brick_wall = Mesh(radiation_simulation.mesh)
geo_3 = Geometry(radiation_simulation.legend)

sim = Python3Script(G_parts=[visualize_2.brick_full_geometry, visualize_2.brick_insulated_geometry], run=run_2)  # -> out, parts; inputs G_parts: list
# ---------- sim: Python ----------
if run == False:
    parts = G_parts
else:
    pass
# ---------- end sim ----------
geo_4 = Geometry([sim.parts, visualize_2.parts_geometry])
geo_5 = Geometry(visualize_2.brick_insulated_geometry)
geo_6 = Geometry(visualize_2.parts_frame)
geo_7 = Geometry([visualize_2.current_part_frame, visualize_2.current_part_geometry])
preview = CustomPreview(Geometry=geo_6, Material=ColourSwatch(SwatchColor=RGB(255, 125, 157)))
preview_2 = CustomPreview(Geometry=geo_7, Material=ColourSwatch(SwatchColor=RGB(255, 125, 157)))
preview_3 = CustomPreview(Geometry=geo_4, Material=ColourSwatch(SwatchColor=RGB(196, 141, 141)))
preview_4 = CustomPreview(Geometry=geo_5, Material=ColourSwatch(SwatchColor=RGB(177, 139, 139)))

# ==== cluster SunHours
epw_file = ClusterInput()
start_month = ClusterInput()
start_day = ClusterInput()
start_hour = ClusterInput()
end_month = ClusterInput()
end_day = ClusterInput()
end_hour = ClusterInput()
importepw = LBImportEPW(epw_file=epw_file)  # -> location, dry_bulb_temperature, dew_point_temperature, relative_humidity, wind_speed, wind_direction, direct_normal_rad, diffuse_horizontal_rad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; plug-in component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
analysisperiod = LBAnalysisPeriod(
    start_month=start_month,
    start_day=start_day,
    start_hour=start_hour,
    end_month=end_month,
    end_day=end_day,
    end_hour=end_hour)  # -> period, hoys, dates; plug-in component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
hoys = ClusterOutput(analysisperiod.hoys)
north = ClusterInput()
skymatrix = LBCumulativeSkyMatrix(
    north=north,
    location=importepw.location,
    direct_rad=importepw.direct_normal_rad,
    diffuse_rad=importepw.diffuse_horizontal_rad,
    hoys=analysisperiod.hoys)  # -> report, sky_mtx; plug-in component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
location = ClusterOutput(importepw.location)
sky_mtx = ClusterOutput(skymatrix.sky_mtx)
colrange = LBColorRange(index=Slider(5, range=0..100))  # -> colors; plug-in component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
base_plane = ClusterInput()
geometry = ClusterInput()
context = ClusterInput()
grid_size = ClusterInput()
run = ClusterInput()
legendpar = LBLegendParameters(colors=colrange, base_plane=base_plane)  # -> leg_par; plug-in component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
incidentradiation = LBIncidentRadiation(
    sky_mtx=skymatrix.sky_mtx,
    geometry=flatten(geometry),
    context=flatten(context),
    grid_size=grid_size,
    offset_dist=Slider(0.2, range=0..1),
    legend_par=legendpar,
    run=run)  # -> report, points, results, total, mesh, legend, title, int_mtx; plug-in component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
legend = ClusterOutput(incidentradiation.legend)
results = ClusterOutput(incidentradiation.results)
mesh = ClusterOutput(incidentradiation.mesh)
points = ClusterOutput(incidentradiation.points)

# ==== cluster RadiationSimulation
colrange = LBColorRange(index=Slider(0, range=0..100))  # -> colors; plug-in component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
sky_mtx = ClusterInput()
geometry = ClusterInput()
context = ClusterInput()
run = ClusterInput()
legendpar = LBLegendParameters(colors=colrange)  # -> leg_par; plug-in component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
incidentradiation = LBIncidentRadiation(
    sky_mtx=sky_mtx,
    geometry=flatten(geometry),
    context=flatten(context),
    grid_size=Slider(1, range=0..1),
    offset_dist=Slider(0.2, range=0..1),
    legend_par=legendpar,
    run=run)  # -> report, points, results, total, mesh, legend, title, int_mtx; plug-in component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
legend = ClusterOutput(incidentradiation.legend)
mesh = ClusterOutput(incidentradiation.mesh)

# ==== cluster Show
geo = Geometry(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)
brick_full = ClusterInput()
brick_insulated = ClusterInput()
brick_half = ClusterInput()
show = ClusterInput()
quad = Quadrangulate(Mesh=geo, Angle=0.03490658504, Ratio=0.875)  # -> Mesh, Count
draw = Python3Script(brick_full=brick_full, brick_insulated=brick_insulated, brick_half=brick_half, show=show)  # -> M, P
# ---------- draw: Python ----------
from compas_rhino.conversions import mesh_to_rhino, box_to_rhino, frame_to_rhino
from robotic_bricklaying.assembly import CAEPart as Part
from compas.geometry import Frame
from compas.geometry import Vector
from compas.geometry import Box


if show=="full":

    #extract the mesh of the part for visulization
    compas_mesh_full = brick_full.mesh

    #convert to rhino mesh
    M = mesh_to_rhino(compas_mesh_full)

    #extract and convert to rhino plane
    P = frame_to_rhino(brick_full.frame)
    #brick_full.gripping_frame = full_brick.frame
    #print(full_brick.__data__)
    print(type(brick_full))

    
elif show == "insulated":
    
    #extract the mesh of the part for visulization
    compas_mesh_insulated = brick_insulated.mesh

    #convert to rhino mesh
    M = mesh_to_rhino(compas_mesh_insulated)
    
    #extract and convert to rhino plane
    P = frame_to_rhino(brick_insulated.frame)

elif show == "half":

    #extract the mesh of the part for visulization
    compas_mesh_half = brick_half.mesh

    #convert to rhino mesh
    M = mesh_to_rhino(compas_mesh_half)
    
    #extract and convert to rhino plane
    P = frame_to_rhino(brick_half.frame)

else:
    pass
# ---------- end draw ----------
referencemodel = Python3Script(units=quad.Mesh)  # -> out, reference_model; inputs units: list of Mesh
# ---------- referencemodel: Python ----------
from robotic_bricklaying.assembly import CAEReferenceModel 
from compas_rhino.conversions import mesh_to_compas
from compas.datastructures import Mesh, CellNetwork


reference_model = CAEReferenceModel()

mesh_units = []
print(mesh_units)
for unit in units:
    mesh_units.append(mesh_to_compas(unit))

reference_model = reference_model.create_cell_network(mesh_units)
print(reference_model)

reference_model.initialize_network()
# ---------- end referencemodel ----------
pln = Plane(draw.P)
M = ClusterOutput(draw.M)
reference_model = ClusterOutput(referencemodel.reference_model)
