# Grasshopper definition robotic_bricklaying_assembly_planning_and_control.ghx (Grasshopper 1.0.8)
# plug-ins: RhinoCodePluginGH

# ----
# IP Settings
# --> Set your IP address
# --> Set robot IP address
server_ip = ValueList({"192.168.0.67", "192.168.0.42", "192.168.10.12", "192.168.10.11", "192.168.10.10", "192.168.10.2", "127.0.0.1", "192.168.10.111", "192.168.0.250", "192.168.0.30", "10.42.0.212", "10.42.0.133"}, selected="127.0.0.1")
ur_ip = ValueList({"192.168.10.10", "192.168.10.20", "192.168.10.11", "192.168.10.12", "127.0.0.1", "192.168.10.111", "192.168.0.210", "192.168.0.211", "192.168.0.30"}, selected="192.168.0.210")
server_port = ValueList({"50002", "50003", "50005", "50006", "50007", "50008", "50009", "50010", "50011", "50012", "50013", "50014", "50015", "50016", "50017", "50018", "50019", "50020", "50021", "50022", "50023", "50024", "50025", "50026", "50027", "50028"}, selected="50003")
ur_port = ValueList({"30002"}, selected="30002")
# Preparation: Make sure the docker desktop is on, and the image is running.
globals = Python3Script(server_ip=server_ip, server_port=server_port, ur_ip=ur_ip, ur_port=ur_port, clear=Button())  # inputs server_ip: String, server_port: Int32, ur_ip: String, ur_port: Int32
# ---------- globals: Python ----------
from scriptcontext import sticky as st

st["server_ip"] = server_ip
st["server_port"] = server_port

st["ur_ip"] = ur_ip
st["ur_port"] = ur_port

if clear:
    st.clear()
# ---------- end globals ----------

# ----
# Check if UR robot
#  is available
ping = Button()
ping_2 = Python3Script(ip=ur_ip, ping=ping)  # -> out; inputs ip: String
# ---------- ping_2: Python ----------
from scriptcontext import sticky as st
from ur_fabrication_control.direct_control.utilities import is_available

guid = str(ghenv.Component.InstanceGuid)
txt_key = "txt_" + guid
if txt_key not in st:
    st[txt_key] = ""

if ping:
    
    available = is_available(ip)
    
    if available:
        st[txt_key] = "%s is up!" % ip
        trigger = True
    else:
        st[txt_key] = "%s is down!" % ip
        trigger = False

print(st[txt_key])
# ---------- end ping_2 ----------
panel = Panel(ping_2)

list = ValueList({"measurement tool": 0, "parallel gripper": 1}, selected="parallel gripper")
show = BooleanToggle(False)

list_2 = ValueList({"origin", "set_to_BCF", "set_to_RCF"}, selected="origin")
origin = Point(Point(-0.03829309328, -0.5916885204, -0.15))
angle = Slider(90, range=0..360)

mesh_table = Mesh(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)
add = Button()
append = Button()
remove = Button()
mesh_object = Mesh(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)

mesh = Mesh(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)
add_2 = Button()
# Assignment help:
# For the assignment, follow the steps marked as -1-,-2-,-3-...
# 
# -1- Select the brick you want to plan for, using the step/back buttons in the counter.
# -2- Redefine the pick plane if you like. Make sure the inverse kinematics works before
# planning (to check set the robot visualisation to analytic inverse kinematics). This is
# your start configuration for motion planning.
# -3- Make sure the robot visualisation is set to motion planning.
# (Before step 4, it will show an error)
# -4- Compute the motion plan. You can press this button again if you want to replan.
# -5- Use the slider to visualize the robot and record images or videos.
# -6- Save the motion plan to the assembly information model.
# 
# Extra -E-:
# In order to access and visualise previous plans, you can switch the robot visualisation to
#  ssembly, and toggle on show current part plan motions in assembly visualisation. Now
# you can use the slider -E- to visualize the robot and record images or videos.
# 
# Be creative and play around with the visualisation tools you have! If you want you can
# move the mobile base around, assemble multiple patches etc. It is all up to you!
# real robot values
remove_2 = Button()

# ----
# 1. Connect to ROS Client
# We connect to the ROS running within the virtual machine in Docker.This should be outputting True.
list_3 = ValueList({"local": "127.0.0.1", "linux computer": "192.168.0.42", "linux eduroam": "10.181.95.254", "linux ccnet": "192.168.0.102", "linux vmware": "192.168.199.36", "robot": "192.168.0.200", "robotAA_wifi": "192.168.0.111", "robotAB_wifi": "192.168.0.112", "robotAB_eduroam": "10.181.67.95"}, selected="local")
connect = BooleanToggle(True)
ros = Python3Script(ip=list_3, port="9090", connect=connect)  # -> out, ros_client, is_connected; inputs ip: String, port: Int32, connect: Boolean
# ---------- ros: Python ----------
"""
Connect or disconnect to ROS.

COMPAS FAB v0.27.0
"""
from scriptcontext import sticky as st

from compas_fab.backends import RosClient

ros_client = None

ip = ip or '127.0.0.1'
port = port or 9090
key = "ros_client_001"
ros_client = st.get(key, None)

if ros_client:
    st[key].close()
if connect:
    st[key] = RosClient(ip, port)
    st[key].run(5)

ros_client = st.get(key, None)
is_connected = ros_client.is_connected if ros_client else False
# ---------- end ros ----------
panel_2 = Panel(ros.is_connected)

attach = Button()
remove_3 = Button()

# ----
# Change the name of the file to your json file, click the import button and load your assembly information model here. Use the counter to go step among the bricks.
import = Button(ExpressionNormal="True", ExpressionPressed="False")

# ----
# Assembly Information Model
# Import from JSON
path = Python3Script()  # -> HERE, DATA
# ---------- path: Python ----------
import os

HERE = os.path.dirname(ghdoc.Path)
DATA = os.path.abspath(os.path.join(HERE, "..", "data"))
print(HERE)
print(DATA)
# ---------- end path ----------
initial_assembly = Python3Script(DATA=path.DATA, filename="assembly_example.json", import_from_json=import)  # -> out, assembly
# ---------- initial_assembly: Python ----------
import os
import json

from robotic_bricklaying.assembly import CAEAssembly as Assembly

if import_from_json:
    filename = filename
    PATH = os.path.join(DATA, "assembly", filename)
    print(PATH)
    assembly = Assembly.from_json(PATH)
    print(assembly)
# ---------- end initial_assembly ----------

list_4 = ValueList({"ur20", "ur20_and_liftkit"}, selected="ur20")
compute = Button()

number_slider = Slider(0, range=-0.3..0.7)

select_configuration = Slider(0, range=0..7)

# ----
# Transform
toggle = BooleanToggle(True)
plane_new = Plane(Plane(origin=(1.146937571, 0.5012943088, 0), x=(0, -1, 0), y=(1, 0, 0)))
transform_assembly = Python3Script(assembly=initial_assembly.assembly, transform=toggle, center_plane_new=plane_new)  # -> out, assembly, node, nodes, plane_c
# ---------- transform_assembly: Python ----------
from compas.geometry import Frame, Transformation, Rotation, Translation
from compas_rhino.conversions import plane_to_compas_frame, point_to_rhino, frame_to_rhino

center_frame = Frame.worldXY()
center_frame_new = plane_to_compas_frame(center_plane_new)


if transform:
    T = Transformation.from_frame_to_frame(center_frame, center_frame_new)
    assembly = assembly.transformed(T)
    

    # Iterate through the parts in the assembly
    for part in assembly.parts():
        # Get the node corresponding to the part's key
        node = assembly.graph.node[part.key]

        # Check for the presence of 'a', 'b', 'c', and 'd' attributes in the node
        if 'a' in node:
            # Get the Frame object, transform it, and store the transformed Frame back
            frame_a = node['a']  # Get the Frame object
            frame_a.transform(T)  # Transform the Frame
            node['a'] = frame_a  # Store the transformed Frame back
            # node_a = frame_a.transformed(T) # Alternative: create a new transformed copy

        if 'b' in node:
            frame_b = node['b']
            frame_b.transform(T)
            node['b'] = frame_b

        if 'c' in node:
            frame_c = node['c']
            frame_c.transform(T)
            node['c'] = frame_c
            print(type(frame_c))
            plane_c = frame_to_rhino(frame_c)
            print(plane_c)
            #print(type(node['c']))  # Verify the type (should be <class 'compas.geometry.Frame'>)

        if 'd' in node:
            frame_d = node['d']
            frame_d.transform(T)
            node['d'] = frame_d
# ---------- end transform_assembly ----------

# ----
# -2-
pickpln = Plane(Plane(origin=(0, -1, 0), x=(1, 0, 0), y=(0, -1, 0)))

# ----
# -4-
# -6-
compute_2 = Button()
save = Button()

# ----
# Export to JSON
panel_3 = Panel("new_example.json")
export = Button(ExpressionNormal="True", ExpressionPressed="False")
export_2 = Python3Script(my_assembly=transform_assembly.assembly, DATA=path.DATA, filename=panel_3, export_assembly=export)  # -> out
# ---------- export_2: Python ----------
import os
import json
from scriptcontext import sticky as st

if export_assembly:
    filename_assembly = filename + ".json"
    PATH = os.path.join(DATA, "assembly", filename_assembly)
    my_assembly.to_json(PATH, pretty=True)
    print(f"Assembly exported to {PATH}")
    print(my_assembly)
# ---------- end export_2 ----------

# ----
# -1-
step = Button()

show_all = BooleanToggle(True)
show_connections = BooleanToggle(False)
show_course = BooleanToggle(False)
show_neighbors = BooleanToggle(False)
highlight_current_part = BooleanToggle(True)
show_current_part_motion_plan = BooleanToggle(True)

start = Button()
stop = Button()
back = Button()
reset = Button()
full = Button()
# Option 1: Real-time planning
# State viewer
# Stop
# Option 2: Pre-planning
# Draw motion
list_5 = ValueList({"20", "50", "100", "500", "1000", "5000"}, selected="50")

counter = Python3Script(
    my_assembly=transform_assembly.assembly,
    start=start,
    stop=stop,
    step=step,
    step_back=back,
    reset=reset,
    full=full,
    interval=list_5)  # -> out, node_key, counter
# ---------- counter: Python ----------
from scriptcontext import sticky as st
import Grasshopper

courses = my_assembly.assembly_courses(tol= 0.0001)
#courses = my_assembly.assembly_courses_xy(tol= 0.0001)
#courses = (my_assembly.assembly_courses_xyz(tol= 0.0001, z_tol = 0.1))


L = [node for course in courses for node in course]
# print(L)



def update_component(ghenv, delay):
    """Schedule an update of the Grasshopper component.

    After the specified delay, the GH component will be automatically updated.

    Parameters
    ----------
    ghenv : :class:`GhPython.Component.PythonEnvironment`
        The current GHPython environment.
    delay : :obj:`int`
        Time in milliseconds until the update is performed.

    Raises
    ------
    ValueError
        If the delay is less than zero.

    """
    if delay <= 0:
        raise ValueError("Delay must be greater than zero")

    ghcomp = ghenv.Component
    ghdoc = ghcomp.OnPingDocument()

    def callback(ghdoc):
        if ghdoc.SolutionState != Grasshopper.Kernel.GH_ProcessStep.Process:
            ghcomp.ExpireSolution(False)

    ghdoc.ScheduleSolution(delay, Grasshopper.Kernel.GH_Document.GH_ScheduleDelegate(callback))




guid = str(ghenv.Component.InstanceGuid)
counter_key = "counter_" + guid
running_key = "running_" + guid

if counter_key not in st:
    st[counter_key] = 0

if running_key not in st:
    st[running_key] = False

if st[running_key]:
    if st[counter_key] < len(L) - 1:
        st[counter_key] += 1
        update_component(ghenv, interval)
    else:
        st[counter_key] = 0
        st[running_key] = False

if start:
    st[running_key] = True

if stop:
    st[running_key] = False

if step:
    if st[counter_key] < len(L) - 1:
        st[counter_key] += 1

if step_back:
    if st[counter_key] < len(L) - 1:
        st[counter_key] -= 1

if reset:
    st[counter_key] = 0
    st[running_key] = False

if full:
    st[counter_key] = len(L) - 1

if len(L):
    node_key = L[st[counter_key]]
    print(f"Current node item: {node_key}")

#st["visualisation_counter"] = st[counter_key]
counter = st[counter_key] #+ 1

print(L)
# ---------- end counter ----------
panel_4 = Panel(counter.counter)

visualize = Python3Script(
    my_assembly=transform_assembly.assembly,
    show_all=show_all,
    show_connections=show_connections,
    show_course=show_course,
    show_neighbors=show_neighbors,
    highlight_current_part=highlight_current_part,
    show_current_part_motion_plan=show_current_part_motion_plan,
    node_key=counter.node_key)  # -> out, parts_geometry, parts_frame, current_part_key, current_part_geometry, current_part_frame, current_part_gripping_frame, current_part_motion_plan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
# ---------- visualize: Python ----------
from compas_rhino.conversions import mesh_to_rhino, box_to_rhino, frame_to_rhino
from compas.colors import Color
import Rhino.Geometry as rg
import ghpythonlib.components as ghcomp
from scriptcontext import sticky as st

courses = my_assembly.assembly_courses(tol= 0.0001)

#courses = my_assembly.assembly_courses_xyz(tol= 0.0001, z_tol = 0.1)
#courses = my_assembly.assembly_courses_xy(tol= 0.0001)

L = [node for course in courses for node in course]

G_neighbors = []
G_connections = []
G_course = []
G_patch = []
G_patches =  []
G_sequence_wtop_key = []
G_patches_color = []


key_index = my_assembly.graph.node_index()
keys = [key_index[key] for key in my_assembly.graph.nodes()]
#key = node_key

#get parts datastructure
parts = [p for p in my_assembly.parts()]
brick_full_parts = [p for p in parts if my_assembly.graph.node_attribute(p.key, "brick_type") == "brick_full"]
brick_insulated_parts = [p for p in parts if my_assembly.graph.node_attribute(p.key, "brick_type") == "brick_insulated"]
brick_air_dried_parts = [p for p in parts if my_assembly.graph.node_attribute(p.key, "brick_type") == "brick_air_dried"]

if show_all:

    brick_full_geometry = []
    brick_insulated_geometry = []
    brick_air_dried_geometry = []
    parts_frame = []

    parts_geometry = [mesh_to_rhino(p.mesh) for p in parts]
    brick_full_geometry = [mesh_to_rhino(p.mesh) for p in brick_full_parts]
    brick_insulated_geometry = [mesh_to_rhino(p.mesh) for p in brick_insulated_parts]
    brick_air_dried_geometry = [mesh_to_rhino(p.mesh) for p in brick_air_dried_parts]

    parts_frame = [frame_to_rhino(p.frame) for p in parts]
    key = my_assembly.graph.number_of_nodes()-1
else:
    current_index = L.index(node_key)
    
    parts_geometry = [mesh_to_rhino(my_assembly.part(key).mesh) for key in L[:current_index + 1]]
    parts_frame = [frame_to_rhino(my_assembly.part(key).frame) for key in L[:current_index + 1]]
    key = node_key

if show_connections:
    edges = list(my_assembly.connections())
    for e in edges:
        part1 = my_assembly.part(e[0])
        part2 = my_assembly.part(e[1])
        if not hasattr(part1.frame, 'point') or not hasattr(part2.frame, 'point'):
            print(f"Missing frame point for edge: {e}")
            continue
        p1 = part1.frame.point
        p2 = part2.frame.point
        G_connections += [rg.Line(p1[0], p1[1], p1[2], p2[0], p2[1], p2[2])]

        # p1 = my_assembly.part(e[0]).frame.point
        # p2 = my_assembly.part(e[1]).frame.point
        # G_connections += [rg.Line(p1[0],p1[1],p1[2],p2[0],p2[1],p2[2])]

if show_neighbors:
    nbrs = my_assembly.graph.neighbors(key=current_index)
    parts = [my_assembly.part(key) for key in nbrs]
    for p in parts:
        G_neighbors.append(mesh_to_rhino(p.mesh))

if show_course:
    total_courses = max(my_assembly.graph.nodes_attribute('course')) + 1
    course = my_assembly.graph.node_attribute(key=node_key, name='course')
    keys_in_course = list(my_assembly.graph.nodes_where({'course': course}))
    parts = [my_assembly.part(key) for key in keys_in_course]
    for p in parts:
        G_course.append(mesh_to_rhino(p.mesh))

if highlight_current_part:
    current_part = my_assembly.part(key)
    current_part_geometry = mesh_to_rhino(current_part.mesh)
    current_part_frame = frame_to_rhino(current_part.frame)
    current_part_gripping_frame = frame_to_rhino(current_part.gripping_frame)
    print(current_part.__data__)

if show_current_part_motion_plan:
    current_part_motion_plan = my_assembly.graph.node_attribute(key, 'place_planes')
    current_part_motion_configs = my_assembly.graph.node_attribute(key, 'place_configs')

current_part_key = key
print(my_assembly)
# ---------- end visualize ----------

# ----
# Visualisation Assembly
panel_5 = Panel(visualize.out)
pln = Plane(visualize.current_part_gripping_frame)

# ----
# -3-
list_6 = ValueList({"0 zero_configuration": 0, "1 forward_kinematics": 1, "2 analytic_inverse_kinematics": 2, "3 inverse_kinematics": 3, "4 motion_planning": 4, "5 assembly": 5}, selected="0 zero_configuration")

show_frames = BooleanToggle(True)
show_visual = BooleanToggle(True)
show_robot_collision = BooleanToggle(False)
show_collision = BooleanToggle(True)
show_attached_collision = BooleanToggle(True)
show_bcf = BooleanToggle(True)
show_rcf = BooleanToggle(True)
show_eef = BooleanToggle(True)

pln_2 = Python3Script(P=visualize.current_part_motion_plan)  # -> P
# ---------- pln_2: Python ----------
print("hi")
# ---------- end pln_2 ----------
geo = Geometry(visualize.current_part_gripping_frame)
geo_2 = Geometry(visualize.G_neighbors)
geo_3 = Geometry(visualize.parts_geometry)
geo_4 = Geometry([visualize.current_part_geometry, visualize.G_connections, visualize.G_course])
geo_5 = Geometry([visualize.parts_frame, visualize.current_part_frame])
preview = CustomPreview(Geometry=geo_3, Material=ColourSwatch(SwatchColor=RGB(196, 141, 141)))
preview_2 = CustomPreview(Geometry=geo_5, Material=ColourSwatch(SwatchColor=RGB(255, 125, 157)))
preview_3 = CustomPreview(Geometry=geo_4, Material=ColourSwatch(SwatchColor=RGB(204, 103, 157)))
preview_4 = CustomPreview(Geometry=geo, Material=ColourSwatch(SwatchColor=RGB(246, 202, 157)))
preview_5 = CustomPreview(Geometry=geo_2, Material=ColourSwatch(SwatchColor=RGB(246, 131, 141)))
pline = PolyLine(Vertices=pln_2, Closed=False)
# Assembly
colour_swatch = ColourSwatch(SwatchColor=RGB(196, 141, 141))
preview_6 = CustomPreview(Geometry=[pline, pln_2], Material=colour_swatch)
draw = Python3Script(planes=geo, scale=Slider(0.2, range=0..1))  # -> out, P, V, C, W; inputs planes: list of Plane
# ---------- draw: Python ----------
from System.Drawing import Color

red = Color.FromArgb(255, 0, 0)
green = Color.FromArgb(0, 255, 0)
blue = Color.FromArgb(0, 0, 255)

P = []
V = []
C = []

scale = float(scale)

for plane in planes:
    if not plane:
        continue
    P += [plane.Origin] * 3
    V.append(plane.XAxis * scale)
    V.append(plane.YAxis * scale)
    V.append(plane.ZAxis * scale)
    C += [red, green, blue]

W = 3
# ---------- end draw ----------
vdisex = VectorDisplayEx(Point=draw.P, Vector=draw.V, Colour=draw.C, Width=draw.W)

# ----
# -E-
select = Python3Script(L=visualize.current_part_motion_configs, i=Slider(0, range=0..100))  # -> a; inputs L: list, i: Int32
# ---------- select: Python ----------
print(len(L))

if i < len(L):
    a = L[i]
else:
    a = L[-1]
# ---------- end select ----------

# ----
# Stop
stop_2 = Button()
stop_3 = Python3Script(stop=stop_2)
# ---------- stop_3: Python ----------
from scriptcontext import sticky as st
from ur_fabrication_control.direct_control.common import send_stop

ur_ip = st["ur_ip"]
ur_port = st["ur_port"]

if stop:
    send_stop(ur_ip, ur_port)
# ---------- end stop_3 ----------

# ----
# 3. Attach tool to robot
# Select the tool you like (parallel gripper for pick and place) and attach to the robot.
path_2 = Python3Script()  # -> DATA
# ---------- path_2: Python ----------
import os

package_path = ghdoc.Path
DATA = os.path.abspath(os.path.join(package_path,"../../data"))

print(package_path)
print(DATA)
# ---------- end path_2 ----------
tool = Python3Script(data_path=path_2, tool=list, show=show)  # -> tool, M, ee_plane; inputs data_path: String
# ---------- tool: Python ----------
import os, math
from compas.geometry import Frame, Rotation, Vector, Quaternion
from compas.datastructures import Mesh
from compas_rhino.conversions import mesh_to_rhino, frame_to_rhino_plane
from compas_fab.robots import Tool

tolerance = 0

if tool == 0:
    filename = 'ur20_measurement_tool.stl'
    #ee_frame = Frame([0, 0, 0], [1, 0, 0], [0, 1, 0])
    ee_frame = Frame([0, 0, 0.29722], [1, 0, 0], [0, 1, 0])

elif tool == 1:
    filename = 'ur20_parallelgripper.stl'
    ee_frame = Frame([0, 0, 0.180 + tolerance],[1, 0, 0], [0, 1, 0])


data_path = os.path.join(data_path, "tool_geometry")
fullfilename = os.path.join(data_path, filename)

ee_mesh = Mesh.from_stl(fullfilename)

if show:
    M = mesh_to_rhino(ee_mesh)

tool = Tool(ee_mesh, ee_frame)
ee_plane = frame_to_rhino_plane(ee_frame)
print(ee_frame.quaternion.xyzw)
ee_framek = Frame([0.0110607,0.00809854,0.41498], [0,1,0], [1,0,0])
print(ee_framek.quaternion.xyzw)
# ---------- end tool ----------
mesh_2 = Mesh(tool.M)  # disabled

# ----
# 2. Load robot from ROS
# Click the LOAD button. You will load the robot model and the robot class. (It can take a while.) Below you can see the details of the robot.
load = Button()
mobile_robot = Python3Script(ros_client=ros.ros_client, load=load)  # -> out, mobile_robot; inputs prefix: String
# ---------- mobile_robot: Python ----------
from mobile_robot_control.mobile_robot import MobileRobot
from mobile_robot_control.mobile_robot_client import MobileRobotClient
from scriptcontext import sticky as st
from compas.scene import SceneObject
import Rhino
import scriptcontext

# Set Rhino document context to the active Rhino doc
scriptcontext.doc = Rhino.RhinoDoc.ActiveDoc

from compas_robots.ghpython.scene import RobotModelObject

key = 'robot_AA'
print(key)
if ros_client and ros_client.is_connected and load:
    # Set Rhino context again before interacting with Rhino-specific objects


    # Load URDF from ROS
    robot = ros_client.load_robot(
            load_geometry=True, 
            urdf_param_name= '{}/robot_description'.format(prefix),
            srdf_param_name= '{}/robot_description_semantic'.format(prefix))
    scriptcontext.doc = ghdoc
    try:
        robot.scene_object = SceneObject(item=robot.model)
    except:
        robot.scene_object = RobotModelObject(robot.model)
    mobile_robot = MobileRobot(robot.model, robot.scene_object, robot.semantics, client=None)
    st[key] = mobile_robot

    
    # Restore the Grasshopper document context after modifying Rhino objects


# Accessing the mobile_robot object in Grasshopper context
mobile_robot = st.get(key, None)
if mobile_robot:
    # Ensure we're in the Grasshopper context before doing operations specific to Grasshopper
    mobile_robot.mobile_client = MobileRobotClient(ros_client)
    mobile_robot.client = ros_client
# ---------- end mobile_robot ----------
robot = Data(mobile_robot.mobile_robot)

# ----
# 5. Set the planning scene
# A planning scene is defined here.
scene = Python3Script(robot=robot)  # -> scene
# ---------- scene: Python ----------
"""
Create a planning scene.

COMPAS FAB v0.28.0
"""

from ghpythonlib.componentbase import executingcomponent as component
from scriptcontext import sticky as st

from compas_fab.ghpython.components import create_id
from compas_fab.robots import PlanningScene


class PlanningSceneComponent(component):
    def RunScript(self, robot):
        key = "planning_scene"
        if robot:
            st[key] = PlanningScene(robot)
        return st.get(key, None)
# ---------- end scene ----------

# ----
# 6. Attach a collision mesh to scene
# You can define a mesh and add it to the planning scene as a collision mesh. (You can show on/off in robot visualisation toggles.)
collision_mesh = Python3Script(scene=scene, mesh=mesh_table, identifier="table", add=add, append=append, remove=remove)  # -> ok, bang; inputs mesh: Mesh, identifier: String
# ---------- collision_mesh: Python ----------
"""
Add or remove a collision mesh from the planning scene.
"""

from compas_rhino.conversions import mesh_to_compas
from compas_fab.robots import CollisionMesh

ok = False
Message = ""

if (add and append) or (append and remove) or (add and remove):
    Message = "Use only one operation at a time\n(add, append or remove)"
    raise Exception(Message)

if scene and mesh and identifier:
    compas_mesh = mesh_to_compas(mesh)
    collision_mesh = CollisionMesh(compas_mesh, identifier)
    if add:
        scene.add_collision_mesh(collision_mesh)
        Message = "Added"
        ok = True
    if append:
        scene.append_collision_mesh(collision_mesh)
        Message = "Appended"
        ok = True
    if remove:
        scene.remove_collision_mesh(identifier)
        Message = "Removed"
        ok = True
# ---------- end collision_mesh ----------
panel_6 = Panel(collision_mesh.ok)

# ----
# 7. Attach an attached collision mesh to robot
# You can define a mesh and add it to the robot as an attached collision mesh.(You can show on/off in robot visualisation toggles.)
attached_collision_mesh = Python3Script(
    scene=scene,
    mesh=mesh,
    identifier="attached_brick",
    link_name="ee_link",
    touch_links="ee_link",
    add=add_2,
    remove=remove_2)  # -> out, attached_collision_mesh, bang; inputs mesh: Mesh
# ---------- attached_collision_mesh: Python ----------
"""
Add an attached collision mesh to the robot.

COMPAS FAB v0.28.0
"""

from compas_rhino.conversions import mesh_to_compas
from ghpythonlib.componentbase import executingcomponent as component

from compas_fab.robots import AttachedCollisionMesh
from compas_fab.robots import CollisionMesh

from compas_ghpython import create_id
import Rhino

class AttachedCollisionMeshComponent(component):
    def RunScript(self,
            scene,
            mesh: Rhino.Geometry.Mesh,
            identifier,
            link_name,
            touch_links,
            add,
            remove):
        attached_collision_mesh = None
        if scene and mesh and identifier and link_name:
            compas_mesh = mesh_to_compas(mesh)
            collision_mesh = CollisionMesh(compas_mesh, identifier)
            attached_collision_mesh = AttachedCollisionMesh(collision_mesh, link_name, touch_links)
            if add:
                scene.add_attached_collision_mesh(attached_collision_mesh)
                scene.attach_collision_mesh_to_robot_end_effector(collision_mesh, group="ur20_and_liftkit")
                scene.attach_collision_mesh_to_robot_end_effector(collision_mesh, group="ur20")
            if remove:
                scene.remove_attached_collision_mesh(identifier)
                scene.remove_collision_mesh(identifier)
        return attached_collision_mesh
# ---------- end attached_collision_mesh ----------
panel_7 = Panel(attached_collision_mesh.attached_collision_mesh)

# ----
# 4. Move the mobile robot base
# You can change where the mobile robot is located by defining a plane here, and changing the dropdown.
plane = Python3Script(origin=origin, angle=angle)  # -> plane; inputs origin: Point3d
# ---------- plane: Python ----------
import Rhino.Geometry as rg
import math

plane = rg.Plane(origin, rg.Vector3d.XAxis, rg.Vector3d.YAxis)
plane.Rotate(math.radians(angle), rg.Vector3d.ZAxis)
# ---------- end plane ----------
set_frame = Python3Script(robot=robot, set_frame_to=list_2, target_BCF=plane, target_RCF=plane)  # -> bang; inputs target_BCF: Plane, target_RCF: Plane
# ---------- set_frame: Python ----------
from compas.geometry import Frame, Point, Vector, Transformation
from compas.datastructures import Mesh
from compas_fab.robots import CollisionMesh
from compas_rhino.conversions import plane_to_compas_frame

if set_frame_to == "set_to_BCF":
    BCF = plane_to_compas_frame(target_BCF)
elif set_frame_to == "set_to_RCF":
    RCF = plane_to_compas_frame(target_RCF)
    BCF = robot.transform_frame_from_RCF_to_BCF(RCF)
else:
    BCF = Frame.worldXY()

if robot:
    robot.BCF = BCF
# ---------- end set_frame ----------

# ----
# Set the Robot & Planning Scene
pln_3 = Plane(tool.ee_plane)  # disabled
info = Python3Script(robot=robot)  # -> out, main_group_name
# ---------- info: Python ----------
if robot:
    robot.info()
    main_group_name = robot.main_group_name
# ---------- end info ----------

attach_tool = Python3Script(robot=robot, tool=tool.tool, attach=attach, remove=remove_3)  # -> tool, M, ee_plane, bang
# ---------- attach_tool: Python ----------
print(robot.get_group_names_from_link_name("robot_arm_flange"))

if attach:
    for planning_group in robot.get_group_names_from_link_name("robot_arm_flange"):
        robot.attach_tool(tool, group=planning_group)
if remove:
    for planning_group in robot.get_group_names_from_link_name("robot_arm_flange"):
        robot.detach_tool(group=planning_group)
# ---------- end attach_tool ----------

panel_8 = Panel(info.out)

# ----
# Robot Kinematics & Planning
# Zero configuration
zero = Python3Script(robot=robot, group=info.main_group_name)  # -> out, configuration; inputs group: String
# ---------- zero: Python ----------
configuration = robot.zero_configuration(group)
# ---------- end zero ----------

# ----
# Forward kinematics
forward_kinematics = Python3Script(
    robot=robot,
    lift=number_slider,
    j1=Slider(180, range=-180..180),
    j2=Slider(-45, range=-360..360),
    j3=Slider(45, range=-180..180),
    j4=Slider(-90, range=-400..400),
    j5=Slider(-90, range=-125..120),
    j6=Slider(0, range=-400..400))  # -> configuration
# ---------- forward_kinematics: Python ----------
import math

from compas_robots.model import Joint
from compas_robots import Configuration


if robot:
    joint_types = robot.get_configurable_joint_types()
    joint_names = robot.get_configurable_joint_names()

    joint_values = [j1, j2, j3, j4, j5, j6]
    for i, joint_value in enumerate(joint_values):
        joint_values[i] = math.radians(joint_values[i])
    
    if len(robot.get_configurable_joints()) == 6:
        configuration = Configuration(joint_values, joint_types, joint_names)
    else:
        configuration = Configuration.from_prismatic_and_revolute_values([lift], joint_values)
    print (configuration)
# ---------- end forward_kinematics ----------

# ----
# Inverse kinematics (MoveIt)
inverse = Python3Script(robot=robot, plane=pickpln, start_configuration=forward_kinematics, group=list_4, compute=compute)  # -> out, configuration
# ---------- inverse: Python ----------
"""
Calculate the robot's inverse kinematic for a given plane.

COMPAS FAB v1.0.2
"""

from compas_rhino.conversions import plane_to_compas_frame
from ghpythonlib.componentbase import executingcomponent as component
from scriptcontext import sticky as st
from compas_robots import Configuration

class InverseKinematics(component):
    def RunScript(self, robot, plane, start_configuration, group, compute):
        key = "inverse_solution"
        configuration = None
        if robot and robot.client and robot.client.is_connected and plane and compute:
            frame_WCF = plane_to_compas_frame(plane)
            frame_BCF = robot.from_WCF_to_BCF(frame_WCF)
            configuration = robot.inverse_kinematics(frame_BCF, start_configuration, group)
            st["inverse_solution"] = configuration
        configuration = st.get("inverse_solution", None)
        print(configuration)
        return configuration
# ---------- end inverse ----------

# ----
# Inverse kinematics (analytical)
analytic_inverse = Python3Script(robot=robot, lift=number_slider, plane=pickpln, idx=select_configuration)  # -> out, configuration, plane_RCF, plane_tool0_RCF; inputs plane: Plane, idx: Int32
# ---------- analytic_inverse: Python ----------
import Rhino.Geometry as rg
import math
from compas.geometry import Frame, Transformation, Rotation
from compas_robots import Configuration
from ur_fabrication_control.kinematics.ur_kinematics import inverse_kinematics
from ur_fabrication_control.kinematics.ur_params import ur_params
from compas_rhino.conversions import plane_to_compas_frame
from compas_ghpython.drawing import draw_frame

# transform frame to robot coordinate system
frame_WCF = plane_to_compas_frame(plane)
frame_RCF = robot.from_WCF_to_RCF(frame_WCF)

if robot.attached_tool:
    tool0_RCF = robot.from_tcf_to_t0cf([frame_RCF])[0]
else:
    tool0_RCF = frame_RCF

plane_tool0_RCF = draw_frame(tool0_RCF)
plane_RCS = draw_frame(frame_RCF)

# calculate solutions to frame
ur_params = ur_params["ur20"] # get the parameters according to the robot model
# print ur_params
solutions = inverse_kinematics(tool0_RCF, ur_params)
print (solutions)

if not len(solutions):
    joint_values = [0, 0, 0, 0, 0, 0]
else:
    joint_values = solutions[idx]

if len(robot.get_configurable_joints()) == 6:
    configuration = Configuration.from_revolute_values(joint_values)
else:
    configuration = Configuration.from_prismatic_and_revolute_values([lift], joint_values)

print(configuration)
# ---------- end analytic_inverse ----------

# ----
# Motion planning (MoveIt)
list_7 = ValueList({"ur20", "ur20_and_liftkit"}, selected="ur20")
constraints_from_plane = Python3Script(robot=robot, plane=visualize.current_part_gripping_frame, group=list_7)  # -> constraints
# ---------- constraints_from_plane: Python ----------
"""
Create a position and an orientation constraint from a plane calculated for the group's end-effector link.

COMPAS FAB v1.0.2
"""

import math

from compas_rhino.conversions import plane_to_compas_frame
from ghpythonlib.componentbase import executingcomponent as component


class ConstraintsFromPlane(component):
    def RunScript(self,
            robot,
            plane,
            group,
            tolerance_position,
            tolerance_xaxis,
            tolerance_yaxis,
            tolerance_zaxis):
        goal_constraints = None
        if robot and plane:
            tolerance_position = tolerance_position or 0.001
            tolerance_xaxis = tolerance_xaxis or 1.0
            tolerance_yaxis = tolerance_yaxis or 1.0
            tolerance_zaxis = tolerance_zaxis or 1.0

            frame_WCF = plane_to_compas_frame(plane)
            frame_BCF = robot.from_WCF_to_BCF(frame_WCF)

            tolerances_axes = [
                math.radians(tolerance_xaxis),
                math.radians(tolerance_yaxis),
                math.radians(tolerance_zaxis),
            ]
            goal_constraints = robot.constraints_from_frame(frame_BCF, tolerance_position, tolerances_axes, group)

        return goal_constraints
# ---------- end constraints_from_plane ----------
plan_motion = Python3Script(
    robot=robot,
    goal_constraints=constraints_from_plane,
    start_configuration=analytic_inverse.configuration,
    group=list_7,
    compute=compute_2)  # -> out, trajectory; inputs goal_constraints: list
# ---------- plan_motion: Python ----------
"""
Calculate a motion path.

COMPAS FAB v1.0.2
"""

from ghpythonlib.componentbase import executingcomponent as component
from scriptcontext import sticky as st


import System

from compas_fab.ghpython.components import create_id


class PlanMotion(component):
    def RunScript(self,
            robot,
            goal_constraints: System.Collections.Generic.List[object],
            start_configuration,
            group,
            attached_collision_meshes,
            path_constraints,
            planner_id,
            compute):
        key = "trajectory"

        path_constraints = list(path_constraints) if path_constraints else None
        attached_collision_meshes = list(attached_collision_meshes) if attached_collision_meshes else None
        planner_id = str(planner_id) if planner_id else "RRTConnect"

        if (
            robot
            and robot.client
            and robot.client.is_connected
            and start_configuration
            and goal_constraints
            and compute
        ):
            st[key] = robot.plan_motion(
                goal_constraints,
                start_configuration=start_configuration,
                group=group,
                options=dict(
                    attached_collision_meshes=attached_collision_meshes,
                    path_constraints=path_constraints,
                    planner_id=planner_id,
                ),
            )

        trajectory = st.get(key, None)
        return trajectory
# ---------- end plan_motion ----------
trajectory_visualize = Python3Script(robot=robot, group=list_7, trajectory=plan_motion.trajectory)  # -> out, start_configuration, configurations, fraction, time, planes, P, V, A
# ---------- trajectory_visualize: Python ----------
"""
Visualizes a trajectory.

COMPAS FAB v1.0.2
"""


from compas_ghpython.sets import list_to_ghtree
from ghpythonlib.componentbase import executingcomponent as component
from compas_rhino.conversions import frame_to_rhino_plane
from compas_robots import Configuration

class TrajectoryVisualize(component):
    def RunScript(self, robot, group, trajectory):
        start_configuration = None
        configurations = []
        fraction = 0.0
        time = 0.0

        planes = []
        positions = []
        velocities = []
        accelerations = []

        if robot and trajectory:
            group = group or robot.main_group_name
            for c in trajectory.points:
                
                config = robot.merge_group_with_full_configuration(
                    c, trajectory.start_configuration, group
                )
                joint_names_ordered = [
                    "robot_ewellix_lift_top_joint",
                    "robot_arm_shoulder_pan_joint",
                    "robot_arm_shoulder_lift_joint",
                    "robot_arm_elbow_joint",
                    "robot_arm_wrist_1_joint",
                    "robot_arm_wrist_2_joint",
                    "robot_arm_wrist_3_joint",
                ]
                joint_values_ordered = [
                    config.joint_values[config.joint_names.index(joint_name)]
                    for joint_name in joint_names_ordered
                ]
                joint_types_ordered = [
                    config.joint_types[config.joint_names.index(joint_name)]
                    for joint_name in joint_names_ordered
                ]
                mobile_robot_config = Configuration(
                    joint_values_ordered, joint_types_ordered, joint_names_ordered
                )
                configurations.append(mobile_robot_config)
                frame = robot.forward_kinematics(c, group, options=dict(solver="model"))
                planes.append(frame_to_rhino_plane(robot.from_BCF_to_WCF(frame)))
                positions.append(c.positions)
                velocities.append(c.velocities)
                accelerations.append(c.accelerations)

            start_configuration = trajectory.start_configuration
            fraction = trajectory.fraction
            time = trajectory.time_from_start

            

        P = list_to_ghtree(list(zip(*positions)))
        V = list_to_ghtree(list(zip(*velocities)))
        A = list_to_ghtree(list(zip(*accelerations)))

        # return outputs if you have them; here I try it for you:
        return (start_configuration, configurations, fraction, time, planes, P, V, A)
# ---------- end trajectory_visualize ----------
# -5-
number_slider_2 = Slider(0, range=0..100)
save_plan_to_assembly = Python3Script(
    my_assembly=transform_assembly.assembly,
    brick_key=visualize.current_part_key,
    configurations=trajectory_visualize.configurations,
    planes=trajectory_visualize.planes,
    save=save)  # -> out; inputs configurations: list, planes: list
# ---------- save_plan_to_assembly: Python ----------
if save:
    my_assembly.graph.node_attribute(brick_key, 'place_configs', configurations)
    my_assembly.graph.node_attribute(brick_key, 'place_planes', planes)
# ---------- end save_plan_to_assembly ----------
select_2 = Python3Script(L=trajectory_visualize.configurations, i=number_slider_2)  # -> a; inputs L: list, i: Int32; same code as select

pln_4 = Python3Script(P=trajectory_visualize.planes)  # -> P; same code as pln_2
pline_2 = PolyLine(Vertices=pln_4, Closed=False)
preview_7 = CustomPreview(Geometry=[pline_2, pln_4], Material=ColourSwatch(SwatchColor=RGB(59, 137, 161)))

# ----
# Visualisation Robot
filter = StreamFilter(
    Gate=list_6,
    Stream0=zero.configuration,
    Stream1=forward_kinematics,
    Stream2=analytic_inverse.configuration,
    Stream3=inverse.configuration,
    Stream4=select_2,
    Stream5=select)
visualise = Python3Script(
    robot=robot,
    configuration=filter,
    show_frames=show_frames,
    show_visual_meshes=show_visual,
    show_robot_collision_meshes=show_robot_collision,
    show_collision_meshes=show_collision,
    show_attached_collision_meshes=show_attached_collision,
    show_BCF=show_bcf,
    show_RCF=show_rcf,
    show_EEF=show_eef,
    bang=[set_frame, attach_tool.bang, collision_mesh.bang, attached_collision_mesh.bang])  # -> out, joint_planes, visual_meshes, robot_collision_meshes, collision_meshes, attached_meshes, BCF, RCF, EEF, EEF_in_RCF; inputs bang: list
# ---------- visualise: Python ----------
from scriptcontext import sticky as st
import time
from compas_ghpython import create_id
from compas.geometry import Frame
from compas.geometry import Transformation
from compas_rhino.conversions import frame_to_rhino, mesh_to_compas, mesh_to_rhino, frame_to_rhino_plane
from compas.scene import SceneObject
from compas_fab.robots import PlanningScene
import Rhino.Geometry as rg
import ghpythonlib.components as ghcomp

robot.update(configuration)
print(configuration)
if show_frames == True: 
    #print(configuration)
    joint_frames = robot.model.transformed_frames(configuration)
    joint_planes = [frame_to_rhino(a) for a in joint_frames]

if show_BCF:
    BCF = frame_to_rhino(robot.BCF)

if show_RCF:
    print(robot.RCF)
    RCF = frame_to_rhino(robot.from_BCF_to_WCF(robot.RCF))

if show_EEF:
    EEF_in_RCF = frame_to_rhino(robot.from_BCF_to_RCF(robot.forward_kinematics(
        configuration, options=dict())))
    EEF = frame_to_rhino(robot.from_BCF_to_WCF(robot.forward_kinematics(
        configuration, options=dict())))
    print(EEF)

if show_visual_meshes == True:
    visual_meshes = robot.draw_visual()
    # orient the robot to its base plane:
    robot_BCF = frame_to_rhino_plane(robot.BCF) 
    print(type(robot_BCF))
    init_robot_plane = rg.Plane.WorldXY
    #visual_meshes = ghcomp.Orient(visual_meshes, init_robot_plane, robot_BCF)[0]

if show_robot_collision_meshes == True:
    robot_collision_meshes = robot.draw_collision()

cached_scene_key = "cached_scene"

if show_collision_meshes or show_attached_collision_meshes:
    cached_scene = st.get(cached_scene_key)
    if not cached_scene:
        cached_scene = {"time": 0}

    # # expire cache if the component has not been executed in the last 2 seconds
    # # this allows to slide through a list of configurations
    # # without triggering refreshes of the scene in the middle of it

    # if time.time() - cached_scene["time"] > 2:
    #     update_scene = True
    # else:
    #     update_scene = False

    update_scene = True

    if update_scene:
        scene = PlanningScene(robot)
        scene = robot.client.get_planning_scene()

    if update_scene and show_collision_meshes:
        collision_meshes = []

        for co in scene.world.collision_objects:
            print(co)
            header = co.header
            frame_id = header.frame_id
            cms = co.to_collision_meshes()

            for cm in cms:
                if cm.frame != Frame.worldXY():
                    t = Transformation.from_frame(cm.frame)
                    mesh = cm.mesh.transformed(t)
                else:
                    mesh = cm.mesh
                collision_meshes.extend(SceneObject(item=mesh).draw())

        cached_scene["cm"] = collision_meshes

        collision_meshes = cached_scene.get("cm", [])

    if update_scene and show_attached_collision_meshes:
        attached_meshes = []

        for aco in scene.robot_state.attached_collision_objects:
            for acm in aco.to_attached_collision_meshes():
                print(acm)
                frame_id = aco.object["header"]["frame_id"]
                frame = robot.forward_kinematics(configuration, options=dict(link=frame_id))
                t = Transformation.from_frame(frame)

                # Local CM frame
                if acm.collision_mesh.frame and acm.collision_mesh.frame != Frame.worldXY():
                    t = t * Transformation.from_frame(acm.collision_mesh.frame)

                mesh = acm.collision_mesh.mesh.transformed(t)

                attached_meshes.extend(SceneObject(item=mesh).draw())

        cached_scene["acm"] = attached_meshes

        attached_meshes = cached_scene.get("acm", [])
    
    cached_scene["time"] = time.time()
    st[cached_scene_key] = cached_scene
# ---------- end visualise ----------
eef_in_rcf = Plane(visualise.EEF_in_RCF)
mesh_3 = Mesh(visualise.visual_meshes)
mesh_4 = Mesh(visualise.collision_meshes)
eef = Plane(visualise.EEF)
pln_5 = Plane(visualise.joint_planes)
mesh_5 = Mesh(visualise.robot_collision_meshes)
mesh_6 = Mesh(visualise.attached_meshes)
py3 = Python3Script(planes=[visualise.EEF, visualise.RCF], scale=Slider(0.2, range=0..1))  # -> P, V, C, W; inputs planes: list of Plane, scale: Double
# ---------- py3: Python ----------
from Rhino.Display import ColorRGBA
from ghpythonlib.components import ColourRGBf


red = ColourRGBf(255, 255, 0, 0)
green = ColourRGBf(255, 0, 255, 0)
blue = ColourRGBf(255, 0, 0, 255)

P = []
V = []
C = []

# scale = float(scale)

for plane in planes:
    if not plane:
        continue
    P += [plane.Origin] * 3
    V.append(plane.XAxis * scale)
    V.append(plane.YAxis * scale)
    V.append(plane.ZAxis * scale)
    C += [red, green, blue]

W = 3
# ---------- end py3 ----------
orient = Orient(Geometry=mesh_3, Source=PlaneXY(0, 0, 0), Target=visualise.BCF)  # -> Geometry, Transform
preview_8 = CustomPreview(Geometry=orient.Geometry, Material=ColourSwatch(SwatchColor=RGB(87, 87, 87)))
vdisex_2 = VectorDisplayEx(Point=py3.P, Vector=py3.V, Colour=py3.C, Width=py3.W)

# ----
# Move Cartesian
radius = Slider(0.003, range=0..0.5)
pln_6 = Plane(Plane(origin=(1.630467741, 0.2394988522, 1.123755367), x=(-0.4120286439, -0.7623659212, -0.4990296572), y=(-0.6723263342, 0.6240251434, -0.3982083885)))
movel = Python3Script(robot=robot, planes_WCS=pln_6, velocity=Slider(0.05, range=0..0.5), radius=radius)  # -> urscript; inputs planes_WCS: list of Plane
# ---------- movel: Python ----------
import Rhino.Geometry as rg
from compas.geometry import Frame
from compas.geometry import Transformation, Rotation
from compas_rhino.conversions import plane_to_compas_frame
from compas_ghpython.drawing import draw_frame
from ur_fabrication_control import direct_control 
import math

from scriptcontext import sticky as st
from ur_fabrication_control.direct_control import URScript

# retrieve the current tool frame in axis angle format
if robot.attached_tool:
    tool_angle_axis = list(robot.attached_tool.frame.point) + list(robot.attached_tool.frame.axis_angle_vector)
else:
    tool0_frame = Frame([0, 0, 0], [1, 0, 0], [0, 1, 0])
    tool_angle_axis = list(tool0_frame.point) + list(tool0_frame.axis_angle_vector)

frames_RCS = []
for plane_WCS in planes_WCS:
    frame_WCS = plane_to_compas_frame(plane_WCS)
    frame_RCS = robot.from_WCF_to_RCF(frame_WCS)
    pose = frame_RCS.point.__data__ + frame_RCS.axis_angle_vector.__data__
    x = "p[{}, {}, {}, {}, {}, {}]".format(*pose)
    print(x)
    frames_RCS.append(frame_RCS)

urscript = URScript()
urscript.start()
urscript.set_tcp(tool_angle_axis)
for frame_RCS in frames_RCS:
    urscript.move_linear(frame=frame_RCS, velocity=velocity, radius=radius)
urscript.end()

urscript = urscript.generate()

print(urscript)
# ---------- end movel ----------
send = Button()
ur_send = Python3Script(urscript=movel, send=send)  # -> out; inputs urscript: String
# ---------- ur_send: Python ----------
from scriptcontext import sticky as st
from ur_fabrication_control.direct_control import send_script

ur_ip = st["ur_ip"]
ur_port = st["ur_port"]

if send:
    send_script(urscript, ur_ip, ur_port)
# ---------- end ur_send ----------

# ----
# Open/close gripper
open = BooleanToggle(False)
gripper = Python3Script(robot=robot, open=open)  # -> urscript
# ---------- gripper: Python ----------
import Rhino.Geometry as rg
from compas.geometry import Frame, Vector, Point
from compas.geometry import Transformation, Rotation, Translation
from compas_rhino.conversions import plane_to_compas_frame, frame_to_rhino_plane
#from compas_ghpython import draw_frame
from ur_fabrication_control import direct_control 
import math

from scriptcontext import sticky as st
from ur_fabrication_control.direct_control.mixins import URScript, URScript_AreaGrip, URScript_ParallelGrip, URScript_Drill

# retrieve the current tool frame in axis angle format
if robot.attached_tool:
    tool_angle_axis = list(robot.attached_tool.frame.point) + list(robot.attached_tool.frame.axis_angle_vector)
else:
    tool0_frame = Frame([0, 0, 0], [1, 0, 0], [0, 1, 0])
    tool_angle_axis = list(tool0_frame.point) + list(tool0_frame.axis_angle_vector)

urscript = URScript_ParallelGrip()
urscript.start()
urscript.set_tcp(tool_angle_axis)
urscript.add_line("sleep(10.0)")

if open_:
    urscript.parallelgrip_open()
else:
    urscript.parallelgrip_close()

urscript.end()

urscript = urscript.generate()

print(urscript)
# ---------- end gripper ----------
send_2 = Button()
ur_send_2 = Python3Script(urscript=gripper, send=send_2)  # -> out; inputs urscript: String
# ---------- ur_send_2: Python ----------
from scriptcontext import sticky as st
from ur_fabrication_control.direct_control import send_script
import time

ur_ip = st["ur_ip"]
ur_port = st["ur_port"]

if send:
    send_script(urscript, ur_ip, ur_port)
# ---------- end ur_send_2 ----------

# ----
# Offline robot control
# Move Joints
list_8 = ValueList({"send forward configuration": 0, "send ik configuration": 1, "send analytic ik config": 2}, selected="send ik configuration")
filter_2 = StreamFilter(Gate=list_8, Stream0=forward_kinematics, Stream1=inverse.configuration, Stream2=analytic_inverse.configuration)
# These commands will not work if the real robot is not connected. They are to control the real robot in the end! :D
movej = Python3Script(configurations=filter_2, velocity=Slider(0.042, range=0..0.5))  # -> urscript, lift, values; inputs configurations: list
# ---------- movej: Python ----------
from ur_fabrication_control.direct_control import URScript
from compas_robots import Configuration
import math

urscript = URScript()
urscript.start()
for configuration in configurations:
    joint_configuration = Configuration.from_revolute_values(configuration.revolute_values)
    print(joint_configuration)
    lift = configuration
    urscript.move_joint(joint_configuration, velocity)
urscript.end()

urscript = urscript.generate()

print(urscript)
# ---------- end movej ----------
send_3 = Button()
ur_send_3 = Python3Script(urscript=movej.urscript, send=send_3)  # -> out; inputs urscript: String
# ---------- ur_send_3: Python ----------
from scriptcontext import sticky as st
from ur_fabrication_control.direct_control import send_script

ur_ip = st["ur_ip"]
ur_port = st["ur_port"]

print(urscript)

if send:
    send_script(urscript, ur_ip, ur_port)
# ---------- end ur_send_3 ----------

# ----
# Get Pose Cartesian
get = Button()
pose = Python3Script(robot=robot, get=get)  # -> out, pose_cartesian
# ---------- pose: Python ----------
from scriptcontext import sticky as st
#from ur_fabrication_control.online_control.ur_direct import get_current_pose_cartesian

from ur_fabrication_control.direct_control.common import get_current_pose_cartesian
from compas.geometry import Frame
#from compas_ghpython import draw_frame


server_ip = st["server_ip"]
server_port = st["server_port"]
ur_port = st["ur_port"]
ur_ip = st["ur_ip"]
pose_cartesian_meter = []

# retrieve the current tool frame in axis angle format
if robot.attached_tool:
    print("attached")
    tool_angle_axis = list(robot.attached_tool.frame.point) + list(robot.attached_tool.frame.axis_angle_vector)
    
else:
    tool0_frame = Frame([0, 0, 0], [1, 0, 0], [0, 1, 0])
    tool_angle_axis = list(tool0_frame.point) + list(tool0_frame.axis_angle_vector)

guid = str(ghenv.Component.InstanceGuid)
pose_cartesian_key = "pose_cartesian" + guid

if pose_cartesian_key not in st:
    st[pose_cartesian_key] = None

if get:
    print("getting pose")
    st[pose_cartesian_key] = get_current_pose_cartesian(tool_angle_axis, server_ip, server_port, ur_ip, ur_port, send=True)
    
pose_cartesian = st[pose_cartesian_key]
# ---------- end pose ----------
# Save ground truth
python = Python3Script(robot=robot, pose=pose.pose_cartesian)  # -> out, plane
# ---------- python: Python ----------
__author__ = "Gido"
__version__ = "2023.07.05"

import rhinoscriptsyntax as rs
from compas.geometry import Frame
#from compas_ghpython import draw_frame

if pose is not None:
    frame_RCS = Frame.from_axis_angle_vector(pose[3:6], pose[0:3])
    T = Transformation.from_change_of_basis(robot.RCF, Frame.worldXY())
    frame_WCS = frame_RCS.transformed(T)
    plane = draw_frame(frame_WCS)
# ---------- end python ----------

# ----
# Get Pose Joint
get_2 = Button()
pose_2 = Python3Script(robot=robot, get=get_2)  # -> out, configuration, pose_joints
# ---------- pose_2: Python ----------
from scriptcontext import sticky as st
from ur_fabrication_control.direct_control.common import get_current_pose_joints
from compas.geometry import Frame
from compas_robots import Configuration


server_ip = st["server_ip"]
server_port = st["server_port"]
ur_port = st["ur_port"]
ur_ip = st["ur_ip"]
print(ur_ip)

guid = str(ghenv.Component.InstanceGuid)
pose_joints_key = "pose_joints" + guid

if pose_joints_key not in st:
    st[pose_joints_key] = None

# retrieve the current tool frame in axis angle format
if robot.attached_tool:
    tool_angle_axis = list(robot.attached_tool.frame.point) + list(robot.attached_tool.frame.axis_angle_vector)
else:
    tool0_frame = Frame([0, 0, 0], [1, 0, 0], [0, 1, 0])
    tool_angle_axis = list(tool0_frame.point) + list(tool0_frame.axis_angle_vector)

print(tool_angle_axis)

# send script to the robot to receive the current joint configuration
if get:
    st[pose_joints_key] = get_current_pose_joints(server_ip, server_port, ur_ip, ur_port, tool_angle_axis)

if st[pose_joints_key] is not None:
    print(st[pose_joints_key])
    configuration = Configuration.from_revolute_values(st[pose_joints_key])
    pose_joints = configuration.joint_values
"""
if pose_joints_key not in st:
    configuration = Configuration.from_revolute_values([0,0,0,0,0,0])
else:
    configuration = Configuration.from_revolute_values(st[pose_joints_key])

pose_joints = configuration.values
"""
# ---------- end pose_2 ----------
panel_9 = Panel(pose_2.pose_joints)
